# Dynamo graph Example Collector QueryName.dyn (Dynamo 1.3.4.6666)

# group: INPUTS
# note: Category of elements to filter
categories = Categories("Doors")
# note: Name of Parameter to Filter with
string = StringInput("Test")
# note: Value of parameter to filter for
string_2 = StringInput("Filter")

# group: OPERATIONS: Get Project Parameter
element_types = ElementTypes("ParameterElement")
filterElementClass = Synthetic.Revit.CollectorElementFilter.FilterElementClass(element_types)
byFilters = Synthetic.Revit.Collector.ByFilters(filterElementClass)
queryNameEquals = Synthetic.Revit.Collector.QueryNameEquals(byFilters, string)
id = Element.Id(queryNameEquals)

stringRules = FilterStringRulesDropDown("Autodesk.Revit.DB.FilterStringContains")  # "FilterParameter.StringRules"

# group: OPERATIONS: Get Elements with parameter value
filterElementCategory = Synthetic.Revit.CollectorElementFilter.FilterElementCategory(categories)
code_block = CodeBlock(l=id) { l[0]; }
filterElementStringParameter = Synthetic.Revit.CollectorElementFilter.FilterElementStringParameter(code_block, string_2, stringRules)
create = List.Create(filterElementCategory, filterElementStringParameter)
byFilters_2 = Synthetic.Revit.Collector.ByFilters(create)
toElements = Synthetic.Revit.Collector.ToElements(byFilters_2)

# group: MONITOR
watch = Watch(toElements)

# group: MONITOR
name = Element.Name(queryNameEquals)
watch_2 = Watch(name)

# group: INPUTS
element_types_2 = ElementTypes("Material")
string_3 = StringInput("Default")

# group: OPERATIONS: Get a materials that contain name
filterElementClass_2 = Synthetic.Revit.CollectorElementFilter.FilterElementClass(element_types_2)
byFilters_3 = Synthetic.Revit.Collector.ByFilters(filterElementClass_2)
queryNameContains = Synthetic.Revit.Collector.QueryNameContains(byFilters_3, string_3)

# group: MONITOR
name_2 = Element.Name(queryNameContains)
watch_3 = Watch(name_2)
