# Dynamo graph Example Collector Views with ViewTemplate Names.dyn (Dynamo 1.3.1.1736)

# group: INPUT
string = StringInput("Arch")

# group: OPERATION: Filter view templates by name
element_types = ElementTypes("View")
filterElementClass = Synthetic.Revit.CollectorElementFilter.FilterElementClass(element_types)
selectBuiltIn = DropDownBuiltInParameters("VIEW_NAME")  # "Parameters.SelectBuiltIn"
filterStringContains = Synthetic.Revit.CollectorFilterRules.StringRules.FilterStringContains()
# note: Filter views whose name contains the input string
filterElementStringParameter = Synthetic.Revit.CollectorElementFilter.FilterElementStringParameter(selectBuiltIn, string, filterStringContains)
create = List.Create(filterElementClass, filterElementStringParameter)
byFilters = Synthetic.Revit.Collector.ByFilters(create)
toElementIds = Synthetic.Revit.Collector.ToElementIds(byFilters)
toInt = Synthetic.Revit.ElementId.ToInt(toElementIds)

# group: MONITOR
watch = Watch(toElementIds)

# group: OPERATIONS: Filter Views
selectBuiltIn_2 = DropDownBuiltInParameters("VIEW_TEMPLATE")  # "Parameters.SelectBuiltIn"
code_block = CodeBlock(viewTemplateIds=toInt) { viewTemplateIds; }
filterNumericEquals = Synthetic.Revit.CollectorFilterRules.NumericRules.FilterNumericEquals()
filterElementIdParameter = Synthetic.Revit.CollectorElementFilter.FilterElementIdParameter(selectBuiltIn_2, code_block, filterNumericEquals)
filterLogicalOr = Synthetic.Revit.CollectorElementFilter.FilterLogicalOr(filterElementIdParameter)
element_types_2 = ElementTypes("View")
filterElementClass_2 = Synthetic.Revit.CollectorElementFilter.FilterElementClass(element_types_2)
create_2 = List.Create(filterLogicalOr, filterElementClass_2)
byFilters_2 = Synthetic.Revit.Collector.ByFilters(create_2)
toElements = Synthetic.Revit.Collector.ToElements(byFilters_2)

# group: MONITOR
watch_2 = Watch(toElements)
