# Dynamo graph Example CompoundStructure Create+Modify.dyn (Dynamo 1.3.2.2480)

# group: INPUTS
# note: Change Width of layer to...
number_from_feet_and_inches = LengthFromString(0.3048)
# note: Name of Layer Function to set layer to...
string = StringInput("Substrate")
# note: Change Material of layer to...
string_2 = StringInput("Aluminum")

# group: OPERATIONS: CREATE COMPOUND STRUCTURE BY DICTIONARY
# note: PACKAGE: Synthetic
string_3 = StringInput("Autodesk.Revit.DB.MaterialFunctionAssignment")
parse = Synthetic.Core.Enumeration.Parse(string_3, string)
allMaterials = Synthetic.Revit.Select.AllMaterials()
getMaterialByName = Synthetic.Revit.Select.GetMaterialByName(allMaterials, string_2)
code_block = CodeBlock(width=number_from_feet_and_inches, layerFunction=parse, layerMaterial=getMaterialByName) { {"Width", "Layer Function", "Material"}; {width, layerFunction, layerMaterial}; }
byKeysValues = Synthetic.Core.Dictionary.ByKeysValues(code_block.out0, code_block.out1)

unwrapDictionary = Synthetic.Core.Dictionary.UnwrapDictionary(byKeysValues)
create = List.Create(unwrapDictionary)

# group (continued): OPERATIONS: CREATE COMPOUND STRUCTURE BY DICTIONARY
byLayerDictionary = Synthetic.Revit.CompoundStructure.ByLayerDictionary(create)

# group: MONITOR
watch = Watch(byLayerDictionary)

# group: INPUTS
# note: Change Width of layer to...
number_from_feet_and_inches_2 = LengthFromString(0.1524)
# note: Name of Layer Function to set layer to...
string_4 = StringInput("Substrate")
# note: Change Material of layer to...
string_5 = StringInput("Aluminum")

# group: OPERATIONS: CREATE COMPOUND STRUCTURE BY PROPERTIES
# note: PACKAGE: Synthetic
string_6 = StringInput("Autodesk.Revit.DB.MaterialFunctionAssignment")
parse_2 = Synthetic.Core.Enumeration.Parse(string_6, string_4)
allMaterials_2 = Synthetic.Revit.Select.AllMaterials()
getMaterialByName_2 = Synthetic.Revit.Select.GetMaterialByName(allMaterials_2, string_5)
code_block_2 = CodeBlock(width=number_from_feet_and_inches_2, layerFunction=parse_2, layerMaterial=getMaterialByName_2)
# ---------- code_block_2.designscript (3 lines) ----------
{width, width + 1, width +2};
{layerFunction, layerFunction, layerFunction};
{layerMaterial, layerMaterial, layerMaterial};
# ----------------------------------------
# note: PACKAGE: Synthetic
# Example showing how to expose the Autodesk.Revit.DB.CompoundStructure object directly to Dynamo.  Unwrap to use with other Revit API scripts.
byLayerProperties = Synthetic.Revit.CompoundStructure.ByLayerProperties(code_block_2.out0, code_block_2.out1, code_block_2.out2)

unwrapCompoundStructure = Synthetic.Revit.CompoundStructure.UnwrapCompoundStructure(byLayerProperties)

# group (continued): OPERATIONS: CREATE COMPOUND STRUCTURE BY PROPERTIES
# note: PACKAGE: Synthetic
# Example showing hot to convert the Autodesk.Revit.DB.CompoundStructure object into a Synthetic.Revit.CompoundStructure object.
wrap = Synthetic.Revit.CompoundStructure.Wrap(unwrapCompoundStructure)

# group: MONITOR
watch_2 = Watch(byLayerProperties)
watch_3 = Watch(unwrapCompoundStructure)
watch_4 = Watch(wrap)

# group: INPUTS
# note: Index of Layer to delete
number_slider = DoubleSlider(1, range=0..10 step 1)

# group: OPERATIONS: DELETE LAYER
code_block_3 = CodeBlock(cs=wrap) { cs; }
# note: PACKAGE: Synthetic
deleteLayer = Synthetic.Revit.CompoundStructure.DeleteLayer(code_block_3, number_slider)

# group: MONITOR
watch_5 = Watch(deleteLayer)

# group: INPUTS
# note: Index of Layer to insert
number_slider_2 = DoubleSlider(1, range=0..10 step 1)
# note: Change Width of layer to...
number_from_feet_and_inches_3 = LengthFromString(0.3048)
# note: Name of Layer Function to set layer to...
string_7 = StringInput("Structure")
# note: Change Material of layer to...
string_8 = StringInput("Aluminum")

# group: OPERATIONS: INSERT LAYER
code_block_4 = CodeBlock(cs=deleteLayer) { cs; }
# note: PACKAGE: Synthetic
string_9 = StringInput("Autodesk.Revit.DB.MaterialFunctionAssignment")
parse_3 = Synthetic.Core.Enumeration.Parse(string_9, string_7)
allMaterials_3 = Synthetic.Revit.Select.AllMaterials()
getMaterialByName_3 = Synthetic.Revit.Select.GetMaterialByName(allMaterials_3, string_8)
insertLayerAtIndex = Synthetic.Revit.CompoundStructure.InsertLayerAtIndex(code_block_4, number_slider_2, number_from_feet_and_inches_3, parse_3, getMaterialByName_3)

# group: MONITOR
watch_6 = Watch(insertLayerAtIndex)

# group: INPUT
# note: Index of layer to get properties of...
number_slider_3 = DoubleSlider(1, range=0..10 step 1)

# group: OPERATIONS: GET LAYER PROPERTIES
code_block_5 = CodeBlock(cs=insertLayerAtIndex, layerIndex=number_slider_3) { cs; layerIndex; }
getLayers = Synthetic.Revit.CompoundStructure.GetLayers(code_block_5.cs)
getLayerFunction = Synthetic.Revit.CompoundStructure.GetLayerFunction(code_block_5.cs, code_block_5.layerIndex)
getLayerMaterial = Synthetic.Revit.CompoundStructure.GetLayerMaterial(code_block_5.cs, code_block_5.layerIndex)
getLayerMaterialId = Synthetic.Revit.CompoundStructure.GetLayerMaterialId(code_block_5.cs, code_block_5.layerIndex)
getLayerWidth = Synthetic.Revit.CompoundStructure.GetLayerWidth(code_block_5.cs, code_block_5.layerIndex)

# group: MONITOR
watch_7 = Watch(getLayers)
watch_8 = Watch(getLayerFunction)
watch_9 = Watch(getLayerMaterial)
watch_10 = Watch(getLayerMaterialId)
watch_11 = Watch(getLayerWidth)

# group: OPERATIONS: GET AND DISPLAY INFORMATION DIRECTLY FROM COMPOUNDSTRUCTURELAYERS
code_block_6 = CodeBlock(cs=insertLayerAtIndex) { cs; }
getCompoundStructureLayers = Synthetic.Revit.CompoundStructure.GetCompoundStructureLayers(code_block_6)
compoundStructureLayerToList = Synthetic.Revit.CompoundStructure.CompoundStructureLayerToList(getCompoundStructureLayers)
setCompoundStructureLayers = Synthetic.Revit.CompoundStructure.SetCompoundStructureLayers(code_block_6, getCompoundStructureLayers)
compoundStructureLayerToDictionary = Synthetic.Revit.CompoundStructure.CompoundStructureLayerToDictionary(getCompoundStructureLayers)

# group: MONITOR
# note: Widths
watch_12 = Watch(compoundStructureLayerToList.out0)
# note: Layer Functions
watch_13 = Watch(compoundStructureLayerToList.out1)
# note: Materials
watch_14 = Watch(compoundStructureLayerToList.out2)
watch_15 = Watch(setCompoundStructureLayers)
watch_16 = Watch(compoundStructureLayerToDictionary)
