# Dynamo graph Example Keyboardshortcuts Create.dyn (Dynamo 2.12.1.8246)
# packages: Synthetic 2.0.200207

# group: INPUT
file_path = Filename("G:\Shared drives\INC Library\INC Software\Revit\Support\Keyboard Shortucts Customization\DEFAULT 2020 - KeyboardShortcuts.xml")
file_path_2 = Filename("G:\Shared drives\INC Library\INC Software\Revit\Support\Keyboard Shortucts Customization\DEFAULT 2021 - KeyboardShortcuts.xml")
file_path_3 = Filename("G:\Shared drives\INC Library\INC Software\Revit\Support\Keyboard Shortucts Customization\DEFAULT 2022 - KeyboardShortcuts.xml")
file_path_4 = Filename("G:\Shared drives\INC Library\INC Software\Revit\Support\Keyboard Shortucts Customization\DEFAULT 2023 - KeyboardShortcuts.xml")
file_path_5 = Filename("G:\Shared drives\INC Library\INC Software\Revit\Support\Keyboard Shortucts Customization\!KeyboardShortcuts INC.xlsx")
string = StringInput("Shortcuts To Add")
# note: If TRUE -> Write XML to file at path below.
# If FALSE -> Do not Write anything to file.
file_path_6 = Filename("G:\Shared drives\INC Library\INC Software\Revit\Support\Keyboard Shortucts Customization\!KeyboardShortcuts INC.xml")
boolean = BoolSelector(false)
file_path_7 = Filename("G:\Shared drives\INC Library\INC Software\Revit\Support\Keyboard Shortucts Customization\INC 2020 - KeyboardShortcuts.xml")
file_path_8 = Filename("G:\Shared drives\INC Library\INC Software\Revit\Support\Keyboard Shortucts Customization\INC 2021 - KeyboardShortcuts.xml")
file_path_9 = Filename("G:\Shared drives\INC Library\INC Software\Revit\Support\Keyboard Shortucts Customization\INC 2022 - KeyboardShortcuts.xml")
file_path_10 = Filename("G:\Shared drives\INC Library\INC Software\Revit\Support\Keyboard Shortucts Customization\INC 2023 - KeyboardShortcuts.xml")

# group: OPERATION: Get KeyboardShortcuts from File
list_create = List.Create(item0=file_path, item1=file_path_2, item2=file_path_3, item3=file_path_4)
file_from_path = FileObject(path=list_create)
readText = FileSystem.ReadText(file=file_from_path)
convertFromXML = Synthetic.Revit.KeyboardShortcuts.KeyboardShortcuts.ConvertFromXML(Xml=readText)

watch = Watch(readText)

# group: OPERATION: Import from Excel
file_from_path_2 = FileObject(path=file_path_5)
code_block = CodeBlock { false; true; }
importExcel = Data.ImportExcel(file=file_from_path_2, sheetName=string, readAsStrings=code_block.out0, showExcel=code_block.out1)
transpose = List.Transpose(lists=importExcel)
code_block_2 = CodeBlock(l=transpose) { l[0]; l[1]; l[2]; l[3]; }

# group: OPERATION: Create KeyboardShortcuts
keyboardShortcutItem = Synthetic.Revit.KeyboardShortcuts.KeyboardShortcutItem.KeyboardShortcutItem(commandName=code_block_2.out0, CommandId=code_block_2.out2, shortcuts=code_block_2.out1, path=code_block_2.out3)
keyboardShortcuts = Synthetic.Revit.KeyboardShortcuts.KeyboardShortcuts.KeyboardShortcuts(shortcuts=keyboardShortcutItem)
removeEmptyShortcuts = Synthetic.Revit.KeyboardShortcuts.KeyboardShortcuts.RemoveEmptyShortcuts(keyboardShortcuts=keyboardShortcuts)

boolean_2 = BoolSelector(false)

# group: OPERATION: File To Write
code_block_3 = CodeBlock(WriteToFile=boolean_2, fileToExport=file_path_6) { WriteToFile; fileToExport; }

# group: OPERATION: Convert to XML and Export to File
convertToXML = Synthetic.Revit.KeyboardShortcuts.KeyboardShortcuts.ConvertToXML(keyboardShortcuts=removeEmptyShortcuts)
code_block_4 = CodeBlock(WriteToFile=code_block_3.WriteToFile, fileToExport=code_block_3.fileToExport) { WriteToFile; fileToExport; null; }
if_ = RefactoredIf(test=code_block_4.WriteToFile, true=code_block_4.fileToExport, false=code_block_4.out2)
writeText = FileSystem.WriteText(filePath=if_, text=convertToXML)

watch_2 = Watch(convertToXML)

# group: WATCH: Compare
compare = Synthetic.Revit.KeyboardShortcuts.KeyboardShortcuts.Compare(First=removeEmptyShortcuts, Second=convertFromXML)
watch_3 = Watch(compare.Duplicates)
watch_4 = Watch(compare.Conflicts)

# group: WATCH: Check file for duplicate Shortcuts
getDuplicateShortcuts = Synthetic.Revit.KeyboardShortcuts.KeyboardShortcuts.GetDuplicateShortcuts(keyboardShortcuts=convertFromXML)
watch_5 = Watch(getDuplicateShortcuts)

# group: OPERATION: Merge Shortcuts Together
code_block_5 = CodeBlock(kbs1=removeEmptyShortcuts, kbs2=convertFromXML) { kbs1; kbs2; }
shortcutItems = Synthetic.Revit.KeyboardShortcuts.KeyboardShortcuts.ShortcutItems(keyboardShortcuts=code_block_5.kbs2)
addShortcut = Synthetic.Revit.KeyboardShortcuts.KeyboardShortcuts.AddShortcut(keyboardShortcuts=code_block_5.kbs1, ShortcutItems=shortcutItems)

watch_6 = Watch(addShortcut.KeyboardShortcuts)

# group: OPERATION: File To Write
list_create_2 = List.Create(item0=file_path_7, item1=file_path_8, item2=file_path_9, item3=file_path_10)
code_block_6 = CodeBlock(WriteToFile=boolean, fileToExport=list_create_2) { WriteToFile; fileToExport; }

# group: OPERATION: Convert to XML and Export to File
code_block_7 = CodeBlock(WriteToFile=code_block_6.WriteToFile, fileToExport=code_block_6.fileToExport) { WriteToFile; fileToExport; null; }
if_2 = RefactoredIf(test=code_block_7.WriteToFile, true=code_block_7.fileToExport, false=code_block_7.out2)
convertToXML_2 = Synthetic.Revit.KeyboardShortcuts.KeyboardShortcuts.ConvertToXML(keyboardShortcuts=addShortcut.KeyboardShortcuts)
writeText_2 = FileSystem.WriteText(filePath=if_2, text=convertToXML_2)

watch_7 = Watch(convertToXML_2)
