# Dynamo graph Example Keyboardshortcuts.dyn (Dynamo 2.12.1.8246)
# packages: Synthetic 2.0.200207

code_block = CodeBlock { "Duplicate View:Duplicate with Detailing"; "ID_DUPLICATE_WITH_DETAILING"; "DD"; "View&gtCreate"; }
keyboardShortcutItem = Synthetic.Revit.KeyboardShortcuts.KeyboardShortcutItem.KeyboardShortcutItem(commandName=code_block.out0, CommandId=code_block.out1, shortcuts=code_block.out2, path=code_block.out3)
code_block_2 = CodeBlock { "DWG"; "ID_EXPORT_DWG"; "DWG"; "Application Menu&gt Export &gtCAD Formats"; }
keyboardShortcutItem_2 = Synthetic.Revit.KeyboardShortcuts.KeyboardShortcutItem.KeyboardShortcutItem(commandName=code_block_2.out0, CommandId=code_block_2.out1, shortcuts=code_block_2.out2, path=code_block_2.out3)
code_block_3 = CodeBlock { "Cut"; "ID_CUT_HOST"; "CT#CG"; "Modify&gtGeometry"; }
keyboardShortcutItem_3 = Synthetic.Revit.KeyboardShortcuts.KeyboardShortcutItem.KeyboardShortcutItem(commandName=code_block_3.out0, CommandId=code_block_3.out1, path=code_block_3.out3)
list_create = List.Create(item0=keyboardShortcutItem, item1=keyboardShortcutItem_2, item2=keyboardShortcutItem_3)
keyboardShortcuts = Synthetic.Revit.KeyboardShortcuts.KeyboardShortcuts.KeyboardShortcuts(shortcuts=list_create)
convertToXML = Synthetic.Revit.KeyboardShortcuts.KeyboardShortcuts.ConvertToXML(keyboardShortcuts=keyboardShortcuts)
watch = Watch(convertToXML)
file_path = Filename("G:\Shared drives\INC Library\INC Software\Revit\Support\Keyboard Shortucts Customization\KeyboardShortcuts Default 2022.xml")
file_from_path = FileObject(path=file_path)
readText = FileSystem.ReadText(file=file_from_path)
watch_2 = Watch(readText)
convertFromXML = Synthetic.Revit.KeyboardShortcuts.KeyboardShortcuts.ConvertFromXML(Xml=readText)
convertToXML_2 = Synthetic.Revit.KeyboardShortcuts.KeyboardShortcuts.ConvertToXML(keyboardShortcuts=convertFromXML)
watch_3 = Watch(convertToXML_2)
shortcutItems = Synthetic.Revit.KeyboardShortcuts.KeyboardShortcuts.ShortcutItems(keyboardShortcuts=convertFromXML)
shortcutList = Synthetic.Revit.KeyboardShortcuts.KeyboardShortcutItem.ShortcutList(keyboardShortcutItem=shortcutItems)
watch_4 = Watch(shortcutList)
shortcutList_2 = Synthetic.Revit.KeyboardShortcuts.KeyboardShortcutItem.ShortcutList(keyboardShortcutItem=list_create)
toShortcutString = Synthetic.Revit.KeyboardShortcuts.KeyboardShortcutItem.ToShortcutString(ShortCutList=shortcutList_2)
watch_5 = Watch(toShortcutString)
getDuplicateShortcuts = Synthetic.Revit.KeyboardShortcuts.KeyboardShortcuts.GetDuplicateShortcuts(keyboardShortcuts=convertFromXML)
watch_6 = Watch(getDuplicateShortcuts)
toDictionaryByShortcut = Synthetic.Revit.KeyboardShortcuts.KeyboardShortcuts.ToDictionaryByShortcut(keyboardShortcuts=convertFromXML)
watch_7 = Watch(toDictionaryByShortcut)
toDictionaryByCommand = Synthetic.Revit.KeyboardShortcuts.KeyboardShortcuts.ToDictionaryByCommand(keyboardShortcuts=convertFromXML)
watch_8 = Watch(toDictionaryByCommand)
removeEmptyShortcuts = Synthetic.Revit.KeyboardShortcuts.KeyboardShortcuts.RemoveEmptyShortcuts(keyboardShortcuts=convertFromXML)
toDictionaryByShortcut_2 = Synthetic.Revit.KeyboardShortcuts.KeyboardShortcuts.ToDictionaryByShortcut(keyboardShortcuts=removeEmptyShortcuts)
watch_9 = Watch(toDictionaryByShortcut_2)
code_block_4 = CodeBlock(d=toDictionaryByShortcut) { d["!NO SHORTCUT!"]; }
watch_10 = Watch(code_block_4)
code_block_5 = CodeBlock(d=toDictionaryByShortcut_2) { d["!NO SHORTCUT!"]; }
watch_11 = Watch(code_block_5)
convertFromXML_2 = Synthetic.Revit.KeyboardShortcuts.KeyboardShortcuts.ConvertFromXML(Xml=convertToXML)
code_block_6 = CodeBlock { "Image"; "ID_FILE_PRINT_TO_IMAGE"; "IM"; "Application Menu&gt"; }
keyboardShortcutItem_4 = Synthetic.Revit.KeyboardShortcuts.KeyboardShortcutItem.KeyboardShortcutItem(commandName=code_block_6.out0, CommandId=code_block_6.out1, shortcuts=code_block_6.out2, path=code_block_6.out3)
addShortcut = Synthetic.Revit.KeyboardShortcuts.KeyboardShortcuts.AddShortcut(keyboardShortcuts=convertFromXML_2, ShortcutItems=keyboardShortcutItem_4)
convertToXML_3 = Synthetic.Revit.KeyboardShortcuts.KeyboardShortcuts.ConvertToXML(keyboardShortcuts=addShortcut.KeyboardShortcuts)
watch_12 = Watch(convertToXML_3)
removeShortcut = Synthetic.Revit.KeyboardShortcuts.KeyboardShortcuts.RemoveShortcut(keyboardShortcuts=addShortcut.KeyboardShortcuts, ShortcutItems=list_create)
removeEmptyShortcuts_2 = Synthetic.Revit.KeyboardShortcuts.KeyboardShortcuts.RemoveEmptyShortcuts(keyboardShortcuts=removeShortcut.KeyboardShortcuts)
convertToXML_4 = Synthetic.Revit.KeyboardShortcuts.KeyboardShortcuts.ConvertToXML(keyboardShortcuts=removeEmptyShortcuts_2)
watch_13 = Watch(convertToXML_4)
toDictionaryByShortcut_3 = Synthetic.Revit.KeyboardShortcuts.KeyboardShortcuts.ToDictionaryByShortcut(keyboardShortcuts=convertFromXML_2)
watch_14 = Watch(toDictionaryByShortcut_3)
