# Dynamo graph Example Material Bitmaps - Copy Bitmaps to New Folder.dyn "Example Materials - Copy Bitmaps to New Folder" (Dynamo 2.12.1.8246)
# packages: Synthetic 2.0.200207

# group: OPERATION: Get all Materials in Document
element_types = ElementTypes("Material")
filterElementClass = Synthetic.Revit.CollectorElementFilter.FilterElementClass(type=element_types)
byFilters = Synthetic.Revit.Collector.ByFilters(filters=filterElementClass)
reset_reload_boolean = BoolSelector(false)
toElements = Synthetic.Revit.Collector.ToElements(collector=byFilters, toggle=reset_reload_boolean)

# group: WATCH: All Materials in the Document
name = Element.Name(element=toElements)
watch = Watch(name)

# group: INPUTS
# note: Subdirectory of the project materials relative to the project Document File location.
material_subdirectory_string = StringInput("\Materials")  # graph input
# note: Firm Material Library Location
inc_material_library_location = StringInput("G:\Shared drives\INC Library\INC Viz\INC Material Maps")  # "INC Material Library Location | String"; graph input
# note: Location to Copy Files To
new_file_location_string = StringInput("G:\My Drive\Material Transmittals")  # graph input
# note: If TRUE -> Overwrite any existing files.
# If FALSE -> Don't overwrite any existing files
overwrite_on_copy_boolean = BoolSelector(true)  # graph input
# note: If TRUE -> Copies the files
# If FALSE -> Does not copy the files.
copy_files_boolean = BoolSelector(false)

code_block = CodeBlock(projectMaterialSubdirectory=material_subdirectory_string, IncMaterialLibrary=inc_material_library_location, newpath=new_file_location_string, overwrite=overwrite_on_copy_boolean, execute=copy_files_boolean) { projectMaterialSubdirectory; IncMaterialLibrary; newpath; overwrite; execute; }

# group: OPERATION: Get current Document's Path + Material Subdirectory
current = Synthetic.Revit.Document.Current()
filePath = Synthetic.Revit.Document.FilePath(document=current)
directoryName = FileSystem.DirectoryName(path=filePath)
concat = String.Concat(string0=directoryName, string1=code_block.projectMaterialSubdirectory)

# group: OPERATION: Create SearchPath
# note: To search more locations, add more path strings to this list
list_create = List.Create(item0=concat, item1=code_block.IncMaterialLibrary)
searchPaths = Synthetic.Core.SearchPaths.SearchPaths(Paths=list_create)
code_block_2 = CodeBlock(searchPath=searchPaths, newpath=code_block.newpath, overwrite=code_block.overwrite, execute=code_block.execute) { searchPath; newpath; overwrite; execute; }

# group: WATCH: All Files in Search Paths
fileLibrary = Synthetic.Core.SearchPaths.FileLibrary(searchPaths=searchPaths)
watch_2 = Watch(fileLibrary)

# group: OPERATION: Get Bitmap Paths
unwrapMaterial = Synthetic.Revit.Material.UnwrapMaterial(DynamoMaterial=toElements)
getMaterialBitmapPaths = Synthetic.Revit.Material.GetMaterialBitmapPaths(Material=unwrapMaterial)

# group: OPERATION: List Management - Remove Empty and Nulls
flatten = List.Flatten(list=getMaterialBitmapPaths)
fileName = FileSystem.FileName(path=flatten)
boolean = BoolSelector(false)
clean = List.Clean(list=fileName, preserveIndices=boolean)
code_block_3 = CodeBlock { ""; }
ne = clean != code_block_3
filterByBoolMask = List.FilterByBoolMask(list=clean, mask=ne)

# group: OPERATION: Copy Bitmap Files
code_block_4 = CodeBlock(searchPath=code_block_2.searchPath, files=filterByBoolMask.in, newpath=code_block_2.newpath, overwrite=code_block_2.overwrite, execute=code_block_2.execute) { searchPath; files; newpath; overwrite; execute; }
code_block_5 = CodeBlock { null; }
if_ = RefactoredIf(test=code_block_4.execute, true=code_block_4.searchPath, false=code_block_5)
copyFiles = Synthetic.Core.SearchPaths.CopyFiles(searchPaths=if_, Files=code_block_4.files, Path=code_block_4.newpath, Overwrite=code_block_4.overwrite)

# group: WATCH: Copy File Results
watch_3 = Watch(copyFiles.Files_Copied)
watch_4 = Watch(copyFiles.Copied)
watch_5 = Watch(copyFiles.Files_Not_Copied)

# group: WATCH: Cleaned up List
watch_6 = Watch(filterByBoolMask.in)
