# Dynamo graph Example Material Bitmaps - Repath Bitmaps.dyn "Materials - Server Migration Repath Bitmaps" (Dynamo 2.3.1.11775)
# packages: Synthetic 2.0.200207

element_types = ElementTypes("Material")
filterElementClass = Synthetic.Revit.CollectorElementFilter.FilterElementClass(type=element_types)
byFilters = Synthetic.Revit.Collector.ByFilters(filters=filterElementClass)
reset_reload_boolean = BoolSelector(false)
toElements = Synthetic.Revit.Collector.ToElements(collector=byFilters, toggle=reset_reload_boolean)
unwrapMaterial = Synthetic.Revit.Material.UnwrapMaterial(DynamoMaterial=toElements)
current = Synthetic.Revit.Document.Current()
filePath = Synthetic.Revit.Document.FilePath(document=current)
directoryName = FileSystem.DirectoryName(path=filePath)
string = StringInput("\Materials")
concat = String.Concat(string0=directoryName, string1=string)
string_2 = StringInput("G:\Shared drives\INC Library\INC Viz\INC Material Maps")
list_create = List.Create(item0=concat, item1=string_2)
searchPaths = Synthetic.Core.SearchPaths.SearchPaths(Paths=list_create)
boolean = BoolSelector(false)
boolean_2 = BoolSelector(false)
replaceBitmapPaths = Synthetic.Revit.Material.ReplaceBitmapPaths(Material=unwrapMaterial, searchPaths=searchPaths, ReplaceRelativePaths=boolean, RunTest=boolean_2)
flatten = List.Flatten(list=replaceBitmapPaths.Paths_Replaced)
boolean_3 = BoolSelector(false)
clean = List.Clean(list=flatten, preserveIndices=boolean_3)
watch = Watch(clean)
flatten_2 = List.Flatten(list=replaceBitmapPaths.Paths_NOT_Replaced)
clean_2 = List.Clean(list=flatten_2, preserveIndices=boolean_3)
watch_2 = Watch(clean_2)
name = Element.Name(element=toElements)
watch_3 = Watch(name)
fileLibrary = Synthetic.Core.SearchPaths.FileLibrary(searchPaths=searchPaths)
watch_4 = Watch(fileLibrary)
