# Dynamo graph Example TransferElementBetweenDocs.dyn (Dynamo 1.3.2.2480)

getAllOpen = Synthetic.Revit.Document.GetAllOpen()
watch = Watch(getAllOpen.out1)
element_types = ElementTypes("WallType")
filterElementClass = Synthetic.Revit.CollectorElementFilter.FilterElementClass(element_types)
byFilters = Synthetic.Revit.Collector.ByFilters(filterElementClass, getAllOpen.out0)
string = StringInput("Generic - 8\"")
queryNameEquals = Synthetic.Revit.Collector.QueryNameEquals(byFilters, string)
unwrapDynamoElement = Synthetic.Revit.Elements.UnwrapDynamoElement(queryNameEquals)
watch_2 = Watch(unwrapDynamoElement)
code_block = CodeBlock(l=unwrapDynamoElement) { l[0][0]; l[1][0]; }
transferElements = Synthetic.Revit.Elements.TransferElements(code_block.out0, code_block.out1)
watch_3 = Watch(transferElements)
