# Dynamo graph Example TransferWallTypeProperties.dyn (Dynamo 1.3.2.2480)

# group: INPUT
wall_types = WallTypes("Exterior - Brick and CMU on MTL. Stud")
wall_types_2 = WallTypes("Generic - 8\"")

# group: OPERATIONS
fromWallType = Synthetic.Revit.CompoundStructure.FromWallType(wall_types)
toWallType = Synthetic.Revit.CompoundStructure.ToWallType(wall_types_2, fromWallType)
transferParameters = Synthetic.Revit.Elements.TransferParameters(wall_types, toWallType)

# group: MONITOR
watch = Watch(transferParameters)

# group: INPUT
wall_types_3 = WallTypes("Exterior - Brick on CMU")
wall_types_4 = WallTypes("Generic - 6\"")

# group: OPERATIONS
transferWallTypeProperties = Synthetic.Revit.WallType.TransferWallTypeProperties(wall_types_3, wall_types_4)

# group: MONITOR
watch_2 = Watch(transferWallTypeProperties)
