# Dynamo graph Example View View3dOrientToggleIsometric.dyn (Dynamo 1.3.2.2480)

# group: INPUT
# note: 3D view to modify
views = Views("3D View 4")
# note: Source view to acquire orientation and cropbox from.
views_2 = Views("Plan Base")
# note: Offset from view origin in direction of viewer
number = DoubleInput(6)

# group: OPERATIONS
# note: Sets the Orientation and cropbox of a 3D view to match an orthagonal view.  Aslo sets the 3D view to Isometric.
view3dOrientToggleIsometric = Synthetic.Revit.Tools.View3dOrientToggleIsometric(views, views_2, number)

# group: WATCH
watch = Watch(view3dOrientToggleIsometric)
