# Dynamo graph Example Views Renumber on All Sheets.dyn (Dynamo 1.3.4.6666)

# group: INPUT
# note: Reset Collector
boolean_reset_collector = BoolSelector(false)

# group: OPERATIONS: Get all sheets in project
element_types = ElementTypes("ViewSheet")
filterElementClass = Synthetic.Revit.CollectorElementFilter.FilterElementClass(element_types)
byFilters = Synthetic.Revit.Collector.ByFilters(filterElementClass)
toElements = Synthetic.Revit.Collector.ToElements(byFilters, boolean_reset_collector)

# group: INPUTS
# note: Select -> Titleblock Location Marker family.
family_types_origin_marker = FamilyTypes("Titleblock Grid Location Marker:Locatin Marker INC Titleblock - CD")
# note: Name of Grid Size Parameters
string = StringInput("Grid Size X Direction")
string_2 = StringInput("Grid Size Y Direction")

# group: OPERATIONS
# note: PACKAGE: Synthetic
renumberOnSheet = Synthetic.Revit.View.RenumberOnSheet(toElements, family_types_origin_marker, string, string_2)

# group: WATCH: Renumbered Viewports
watch = Watch(renumberOnSheet)

# group: WATCH: All Sheets in the Project
watch_2 = Watch(toElements)
