# Dynamo custom node Json.Decode.dyf (Dynamo 1.2.1.3083)
# category: Synthetic.Core..Json
# Input a text string formated in JSON, return a nested list.

json = Input()
# note: Decode a settings group from JSON
python_script = Python(IN[0]=json)
# ---------- python_script.python (15 lines) ----------
import clr
clr.AddReference('ProtoGeometry')
from Autodesk.DesignScript.Geometry import *
import sys
sys.path.append("C:\Program Files (x86)\IronPython 2.7\Lib")
import json
#The inputs to this node will be stored as a list in the IN variables.
data = IN[0]

d1 = json.loads(data)
k=d1.keys()
v=d1[k[0]].items()

#Assign your output to the OUT variable.
OUT = [k[0],v]
# ----------------------------------------
list = Output(python_script)
