# Dynamo custom node Json.Encode.dyf (Dynamo 1.2.1.3083)
# category: Synthetic.Core.Json
# Input a title and list of list pairs, node encodes the lists into JSON.

title = Input(title : string = "")
list = Input()
# note: Encode a list to JSON
python_script = Python(IN[0]=title, IN[1]=list)
# ---------- python_script.python (16 lines) ----------
import clr
clr.AddReference('ProtoGeometry')
from Autodesk.DesignScript.Geometry import *
import sys
sys.path.append("C:\Program Files (x86)\IronPython 2.7\Lib")
import json
#The inputs to this node will be stored as a list in the IN variables.
title = IN[0]
data = IN[1]

d1 = dict(data)
j1 = json.dumps(d1)
d2 = {title : d1}
j2 = json.dumps(d2)
#Assign your output to the OUT variable.
OUT = j2
# ----------------------------------------
json = Output(python_script)
