# Dynamo custom node RoundInches.dyf (Dynamo 1.2.1.3083)
# category: Synthetic.Core.Units
# Round a number to the nearest inch or fractional inch.

number = Input(number : double)
precision = Input(precision : double = 1.0)
code_block = CodeBlock(n=number, s=precision) { Math.Round(n*12/s)/12*s; }
number_2 = Output(code_block)  # "number : double"
