# Dynamo graph Example Change Levels Workset Filtered.dyn (Dynamo 1.2.1.3083)

# note: Category of elements to change workset.
categories = Categories("Levels")
string = StringInput("Type")
# note: Name of the Level Type to change
string_2 = StringInput("NCS")

# group: OPERATIONS
# note: Filter for the levels of the chosen type.
all_elements_of_category = ElementsOfCategory(categories)
getParameterValueByName = Element.GetParameterValueByName(element=all_elements_of_category, parameterName=string)
name = FamilyType.Name(getParameterValueByName)
code_block = CodeBlock(levelType=string_2) { levelType; }
code_block_2 = CodeBlock(l=name, name=code_block) { l == name; }
filterByBoolMask = List.FilterByBoolMask(list=all_elements_of_category, mask=code_block_2)

# note: Name of the workset to change the elements to.
string_3 = StringInput("Workset1")

# group: OPERATIONS
# note: Package: Synthetic
# note: Change the level's workset.
getByName = Synthetic.Revit.Workset.GetByName(string_3)
setElementWorkset = Synthetic.Revit.Workset.SetElementWorkset(filterByBoolMask.in, getByName)
getElementWorkset = Synthetic.Revit.Workset.GetElementWorkset(setElementWorkset)
name_2 = Synthetic.Revit.Workset.Name(getElementWorkset)

# group: MONITOR
# note: Verify that the elements have been changed to the correct workset.
watch = Watch(name_2)

# group: MONITOR
watch_2 = Watch(all_elements_of_category)
watch_3 = Watch(filterByBoolMask.in)
watch_4 = Watch(name)

# group: OPERATIONS
# note: Check the names of the Level Types in the project.
element_types = ElementTypes("LevelType")
all_elements_of_type = ElementsOfType(element_types)
name_3 = Element.Name(all_elements_of_type)

# group: MONITOR
watch_5 = Watch(name_3)
