# Dynamo graph Example Change Levels Workset.dyn (Dynamo 1.2.1.3083)

string = StringInput("Workset1")
# note: Category of elements to change workset.
categories = Categories("Levels")

# group: OPERATIONS
getUserWorksets = Synthetic.Revit.Workset.GetUserWorksets()
name = Synthetic.Revit.Workset.Name(getUserWorksets)

# note: Name of the workset to change the elements to.
number_slider = DoubleSlider(0, range=0..5 step 1)

# group: OPERATIONS
all_elements_of_category = ElementsOfCategory(categories)
code_block = CodeBlock(name=name, n=number_slider) { name[n]; }
# note: Package: Synthetic
getByName = Synthetic.Revit.Workset.GetByName(code_block)
setElementWorkset = Synthetic.Revit.Workset.SetElementWorkset(all_elements_of_category, getByName)
getElementWorkset = Synthetic.Revit.Workset.GetElementWorkset(setElementWorkset)
name_2 = Synthetic.Revit.Workset.Name(getElementWorkset)

# group: OPERATIONS
# note: Package: Synthetic
getElementWorkset_2 = Synthetic.Revit.Workset.GetElementWorkset(all_elements_of_category)
name_3 = Synthetic.Revit.Workset.Name(getElementWorkset_2)

# group: MONITOR
watch = Watch(name_3)
watch_2 = Watch(name_2)

# group: MONITOR
watch_3 = Watch(code_block)
watch_4 = Watch(name)
