# Dynamo graph Example Collector.dyn (Dynamo 1.2.1.3083)

element_types = ElementTypes("WallType")
filterElementClass = Synthetic.Revit.Collector.FilterElementClass(element_types)
byFilters = Synthetic.Revit.Collector.ByFilters(filterElementClass)
boolean = BoolSelector(false)
toElements = Synthetic.Revit.Collector.ToElements(byFilters, boolean)
watch = Watch(toElements)
categories = Categories("Windows")
id = Category.Id(categories)
filterElementCategory = Synthetic.Revit.Collector.FilterElementCategory(id)
filterElementIsElementType = Synthetic.Revit.Collector.FilterElementIsElementType()
create = List.Create(filterElementCategory, filterElementIsElementType)
byFilters_2 = Synthetic.Revit.Collector.ByFilters(create)
boolean_2 = BoolSelector(false)
toElements_2 = Synthetic.Revit.Collector.ToElements(byFilters_2, boolean_2)
watch_2 = Watch(toElements_2)
code_block = CodeBlock(type=element_types) { type; }
allElementsOfType = Synthetic.Revit.Select.AllElementsOfType(code_block)
watch_3 = Watch(allElementsOfType)
code_block_2 = CodeBlock(passthrough=id) { passthrough; }
allElementsOfCategory = Synthetic.Revit.Select.AllElementsOfCategory(code_block_2)
watch_4 = Watch(allElementsOfCategory)
all_family_types_of_category = Custom[All Family Types Of Category](category=categories)  # Gets all family types/symbols of a given category in the model (does *not *work for system families)
allFamilyTypesOfCategory = Synthetic.Revit.Select.AllFamilyTypesOfCategory(code_block_2)
watch_5 = Watch(allFamilyTypesOfCategory)
getFilters = Synthetic.Revit.Collector.GetFilters(byFilters)
watch_6 = Watch(getFilters)
getFilters_2 = Synthetic.Revit.Collector.GetFilters(byFilters_2)
watch_7 = Watch(getFilters_2)
toElementIds = Synthetic.Revit.Collector.ToElementIds(byFilters_2)
watch_8 = Watch(toElementIds)
unwrap = Synthetic.Revit.Collector.Unwrap(byFilters)
watch_9 = Watch(unwrap)
filterIsInverted = Synthetic.Revit.Collector.FilterIsInverted(filterElementIsElementType)
family_types = FamilyTypes("Fixed:16\" x 24\"")
id_2 = Element.Id(family_types)
filterFamilySymbol = Synthetic.Revit.Collector.FilterFamilySymbol(id_2)
type = Synthetic.Core.Object.Type()  # unwired: arg0
filterElementDesignOption = Synthetic.Revit.Collector.FilterElementDesignOption()  # unwired: arg0
filterElementIsElementType_2 = Synthetic.Revit.Collector.FilterElementIsElementType()
filterElementLevel = Synthetic.Revit.Collector.FilterElementLevel()  # unwired: arg0
filterElementMulticategory = Synthetic.Revit.Collector.FilterElementMulticategory()  # unwired: arg0
filterElementWorkset = Synthetic.Revit.Collector.FilterElementWorkset()  # unwired: arg0
filterExclusion = Synthetic.Revit.Collector.FilterExclusion()  # unwired: arg0
filterLogicalAnd = Synthetic.Revit.Collector.FilterLogicalAnd()  # unwired: arg0
filterLogicalOr = Synthetic.Revit.Collector.FilterLogicalOr()  # unwired: arg0
