# Dynamo graph Example CompoundStructure Create+Modify.dyn (Dynamo 1.3.0.875)

# group: INPUTS
# note: Change Width of layer to...
number_from_feet_and_inches = LengthFromString(0.3048)
# note: Name of Layer Function to set layer to...
string = StringInput("Substrate")
# note: Change Material of layer to...
string_2 = StringInput("Aluminum")

# group: INPUTS
# note: Change Width of layer to...
number_from_feet_and_inches_2 = LengthFromString(0.1524)
# note: Name of Layer Function to set layer to...
string_3 = StringInput("Substrate")
# note: Change Material of layer to...
string_4 = StringInput("Aluminum")

# group: OPERATIONS: CREATE COMPOUND STRUCTURE BY PROPERTIES
# note: PACKAGE: Synthetic
string_5 = StringInput("Autodesk.Revit.DB.MaterialFunctionAssignment")
parse = Synthetic.Core.Enumeration.Parse(string_5, string_3)
allMaterials = Synthetic.Revit.Select.AllMaterials()
getMaterialByName = Synthetic.Revit.Select.GetMaterialByName(allMaterials, string_4)
code_block = CodeBlock(width=number_from_feet_and_inches_2, layerFunction=parse, layerMaterial=getMaterialByName)
# ---------- code_block.designscript (3 lines) ----------
{width, width + 1, width +2};
{layerFunction, layerFunction, layerFunction};
{layerMaterial, layerMaterial, layerMaterial};
# ----------------------------------------
byLayerProperties = Synthetic.Revit.CompoundStructure.ByLayerProperties(code_block.out0, code_block.out1, code_block.out2)
# note: PACKAGE: Synthetic
# Example showing how to expose the Autodesk.Revit.DB.CompoundStructure object directly to Dynamo.  Unwrap to use with other Revit API scripts.
unwrap = Synthetic.Revit.CompoundStructure.Unwrap(byLayerProperties)
# note: PACKAGE: Synthetic
# Example showing hot to convert the Autodesk.Revit.DB.CompoundStructure object into a Synthetic.Revit.CompoundStructure object.
wrap = Synthetic.Revit.CompoundStructure.Wrap(unwrap)

# group: INPUTS
# note: Index of Layer to delete
number_slider = DoubleSlider(1, range=0..10 step 1)

# group: OPERATIONS: DELETE LAYER
code_block_2 = CodeBlock(cs=wrap) { cs; }
# note: PACKAGE: Synthetic
deleteLayer = Synthetic.Revit.CompoundStructure.DeleteLayer(code_block_2, number_slider)

# group: INPUTS
# note: Index of Layer to insert
number_slider_2 = DoubleSlider(1, range=0..10 step 1)
# note: Change Width of layer to...
number_from_feet_and_inches_3 = LengthFromString(0.3048)
# note: Name of Layer Function to set layer to...
string_6 = StringInput("Structure")
# note: Change Material of layer to...
string_7 = StringInput("Aluminum")

# group: OPERATIONS: INSERT LAYER
code_block_3 = CodeBlock(cs=deleteLayer) { cs; }
# note: PACKAGE: Synthetic
string_8 = StringInput("Autodesk.Revit.DB.MaterialFunctionAssignment")
parse_2 = Synthetic.Core.Enumeration.Parse(string_8, string_6)
allMaterials_2 = Synthetic.Revit.Select.AllMaterials()
getMaterialByName_2 = Synthetic.Revit.Select.GetMaterialByName(allMaterials_2, string_7)
insertLayerAtIndex = Synthetic.Revit.CompoundStructure.InsertLayerAtIndex(code_block_3, number_slider_2, number_from_feet_and_inches_3, parse_2, getMaterialByName_2)

# group: OPERATIONS: GET AND DISPLAY INFORMATION DIRECTLY FROM COMPOUNDSTRUCTURELAYERS
code_block_4 = CodeBlock(cs=insertLayerAtIndex) { cs; }
getCompoundStructureLayers = Synthetic.Revit.CompoundStructure.GetCompoundStructureLayers(code_block_4)
compoundStructureLayerToDictionary = Synthetic.Revit.CompoundStructure.CompoundStructureLayerToDictionary(getCompoundStructureLayers)
compoundStructureLayerToList = Synthetic.Revit.CompoundStructure.CompoundStructureLayerToList(getCompoundStructureLayers)
setCompoundStructureLayers = Synthetic.Revit.CompoundStructure.SetCompoundStructureLayers(code_block_4, getCompoundStructureLayers)

# group: OPERATIONS: CREATE COMPOUND STRUCTURE BY DICTIONARY
# note: PACKAGE: Synthetic
string_9 = StringInput("Autodesk.Revit.DB.MaterialFunctionAssignment")
parse_3 = Synthetic.Core.Enumeration.Parse(string_9, string)
allMaterials_3 = Synthetic.Revit.Select.AllMaterials()
getMaterialByName_3 = Synthetic.Revit.Select.GetMaterialByName(allMaterials_3, string_2)
code_block_5 = CodeBlock(width=number_from_feet_and_inches, layerFunction=parse_3, layerMaterial=getMaterialByName_3) { {"Width", "Layer Function", "Material"}; {width, layerFunction, layerMaterial}; }
byKeysValues = Synthetic.Core.Dictionary.ByKeysValues(code_block_5.out0, code_block_5.out1)
unwrap_2 = Synthetic.Core.Dictionary.Unwrap(compoundStructureLayerToDictionary)
# note: PACKAGE: Synthetic
# KNOWN ISSUE: Node currently does not work.
byLayerDictionary = Synthetic.Revit.CompoundStructure.ByLayerDictionary(unwrap_2)

# group: MONITOR
watch = Watch(byLayerDictionary)

# group: MONITOR
watch_2 = Watch(byLayerProperties)
watch_3 = Watch(unwrap)
watch_4 = Watch(wrap)

# group: MONITOR
watch_5 = Watch(deleteLayer)

# group: MONITOR
watch_6 = Watch(insertLayerAtIndex)

# group: INPUT
# note: Index of layer to get properties of...
number_slider_3 = DoubleSlider(1, range=0..10 step 1)

# group: OPERATIONS: GET LAYER PROPERTIES
code_block_6 = CodeBlock(cs=insertLayerAtIndex, layerIndex=number_slider_3) { cs; layerIndex; }
getLayers = Synthetic.Revit.CompoundStructure.GetLayers(code_block_6.cs)
getLayerFunction = Synthetic.Revit.CompoundStructure.GetLayerFunction(code_block_6.cs, code_block_6.layerIndex)
getLayerMaterial = Synthetic.Revit.CompoundStructure.GetLayerMaterial(code_block_6.cs, code_block_6.layerIndex)
getLayerMaterialId = Synthetic.Revit.CompoundStructure.GetLayerMaterialId(code_block_6.cs, code_block_6.layerIndex)
getLayerWidth = Synthetic.Revit.CompoundStructure.GetLayerWidth(code_block_6.cs, code_block_6.layerIndex)

# group: MONITOR
watch_7 = Watch(getLayers)
watch_8 = Watch(getLayerFunction)
watch_9 = Watch(getLayerMaterial)
watch_10 = Watch(getLayerMaterialId)
watch_11 = Watch(getLayerWidth)

# group: MONITOR
# note: Widths
watch_12 = Watch(compoundStructureLayerToList.out0)
# note: Layer Functions
watch_13 = Watch(compoundStructureLayerToList.out1)
# note: Materials
watch_14 = Watch(compoundStructureLayerToList.out2)
watch_15 = Watch(setCompoundStructureLayers)
watch_16 = Watch(compoundStructureLayerToDictionary)
