# Dynamo graph Example CompoundStructure Modify Layers.dyn (Dynamo 1.3.0.875)

# group: INPUTS
# note: If TRUE, modify WallType, else do not modify WallType.
boolean = BoolSelector(false)
# note: Select a Wall Type to Modify
wall_types = WallTypes("Interior - 4 7/8\" Partition (1-hr)")
# note: Select the Layer to Modify
number_slider = DoubleSlider(1, range=0..5 step 1)
# note: Change Width of layer to...
number_from_feet_and_inches = LengthFromString(0.3048)
# note: Name of Layer Function to set layer to...
string = StringInput("Substrate")
# note: Change Material of layer to...
string_2 = StringInput("Aluminum")

# group: OPERATIONS: GET COMPOUND STRUCTURE AND MODIFY WALL TYPE
code_block = CodeBlock(proceed=boolean, wallType=wall_types) { proceed; wallType; }
# note: PACKAGE: Synthetic
# Get CompoundStructure from WallType
fromWallType = Synthetic.Revit.CompoundStructure.FromWallType(code_block.wallType)
code_block_2 = CodeBlock { null; }
if_ = If(test=code_block.proceed, true=code_block.wallType, false=code_block_2)

# group: MONITOR
watch = Watch(fromWallType)

# group: OPERATIONS: SET LAYER WIDTH
code_block_3 = CodeBlock(layerIndex=number_slider, width=number_from_feet_and_inches) { layerIndex; width; }
# note: PACKAGE: Synthetic
setLayerWidth = Synthetic.Revit.CompoundStructure.SetLayerWidth(fromWallType, code_block_3.layerIndex, code_block_3.width)

# group: OPERATIONS: SET LAYER MATERIAL FUNCTION
code_block_4 = CodeBlock(layerIndex=number_slider, layerFunctionName=string) { layerIndex; layerFunctionName; }
string_3 = StringInput("Autodesk.Revit.DB.MaterialFunctionAssignment")
# note: PACKAGE: Synthetic
parse = Synthetic.Core.Enumeration.Parse(string_3, code_block_4.layerFunctionName)
setLayerFunction = Synthetic.Revit.CompoundStructure.SetLayerFunction(setLayerWidth, code_block_4.layerIndex, parse)

# group: OPERTIONS: SET LAYER MATERIAL
code_block_5 = CodeBlock(layerIndex=number_slider, MaterialName=string_2) { layerIndex; MaterialName; }
# note: PACKAGE: Synthetic
allMaterials = Synthetic.Revit.Select.AllMaterials()
getMaterialByName = Synthetic.Revit.Select.GetMaterialByName(allMaterials, code_block_5.MaterialName)
setLayerMaterial = Synthetic.Revit.CompoundStructure.SetLayerMaterial(setLayerFunction, code_block_5.layerIndex, getMaterialByName)

# group: MONITOR
getLayers = Synthetic.Revit.CompoundStructure.GetLayers(setLayerMaterial)
watch_2 = Watch(getLayers)

# group: MONITOR
watch_3 = Watch(parse)

# group (continued): OPERATIONS: GET COMPOUND STRUCTURE AND MODIFY WALL TYPE
# note: PACKAGE: Synthetic
toWallType = Synthetic.Revit.CompoundStructure.ToWallType(if_, setLayerMaterial)

# group: MONITOR
watch_4 = Watch(toWallType)

# group: INPUTS
# note: If TRUE, modify WallType, else do not modify WallType.
boolean_2 = BoolSelector(false)
# note: Select a Wall Type to Modify
wall_types_2 = WallTypes("Interior - 5\" Partition (2-hr)")
# note: Select the Layer to Modify
number_slider_2 = DoubleSlider(2, range=0..5 step 1)
# note: Change Width of layer to...
number_from_feet_and_inches_2 = LengthFromString(0.3048)
# note: Name of Layer Function to set layer to...
string_4 = StringInput("Substrate")
# note: Change Material of layer to...
string_5 = StringInput("Aluminum")

# group: OPERATIONS: ALTERNATE METHOD FOR MODIFYING WALL LAYERS
code_block_6 = CodeBlock(proceed=boolean_2, wallType=wall_types_2, layerIndex=number_slider_2, width=number_from_feet_and_inches_2, layerFunctionName=string_4, MaterialName=string_5) { proceed; wallType; layerIndex; width; layerFunctionName; MaterialName; }
code_block_7 = CodeBlock { null; }
# note: Hold on modifying WallType unless toggle set to true
if_2 = If(test=code_block_6.proceed, true=code_block_6.wallType, false=code_block_7)
# note: PACKAGE: Synthetic
# Get CompoundStructure from WallType
fromWallType_2 = Synthetic.Revit.CompoundStructure.FromWallType(code_block_6.wallType)
string_6 = StringInput("Autodesk.Revit.DB.MaterialFunctionAssignment")
# note: PACKAGE: Synthetic
parse_2 = Synthetic.Core.Enumeration.Parse(string_6, code_block_6.layerFunctionName)
allMaterials_2 = Synthetic.Revit.Select.AllMaterials()
getMaterialByName_2 = Synthetic.Revit.Select.GetMaterialByName(allMaterials_2, code_block_6.MaterialName)
setLayer = Synthetic.Revit.CompoundStructure.SetLayer(fromWallType_2, code_block_6.layerIndex, code_block_6.width, parse_2, getMaterialByName_2)
toWallType_2 = Synthetic.Revit.CompoundStructure.ToWallType(if_2, setLayer)

# group: MONITOR
watch_5 = Watch(toWallType_2)

# group: MONITOR
watch_6 = Watch(fromWallType_2)

# group: INPUTS
# note: Change Width of layer to...
number_from_feet_and_inches_3 = LengthFromString(0.3048)
# note: Name of Layer Function to set layer to...
string_7 = StringInput("Substrate")
# note: Change Material of layer to...
string_8 = StringInput("Aluminum")

# note: PACKAGE: Synthetic
string_9 = StringInput("Autodesk.Revit.DB.MaterialFunctionAssignment")
parse_3 = Synthetic.Core.Enumeration.Parse(string_9, string_7)
allMaterials_3 = Synthetic.Revit.Select.AllMaterials()
getMaterialByName_3 = Synthetic.Revit.Select.GetMaterialByName(allMaterials_3, string_8)
code_block_8 = CodeBlock(width=number_from_feet_and_inches_3, layerFunction=parse_3, layerMaterial=getMaterialByName_3) { {"Width", "Layer Function", "Material"}; {width, layerFunction, layerMaterial}; }
byKeysValues = Synthetic.Core.Dictionary.ByKeysValues(code_block_8.out0, code_block_8.out1)
unwrap = Synthetic.Core.Dictionary.Unwrap(byKeysValues)
byLayerDictionary = Synthetic.Revit.CompoundStructure.ByLayerDictionary(unwrap)

# group: MONITOR
watch_7 = Watch(byLayerDictionary)

code_block_9 = CodeBlock(width=number_from_feet_and_inches_3, layerFunction=parse_3, layerMaterial=getMaterialByName_3)
# ---------- code_block_9.designscript (3 lines) ----------
{width, width + 1, width +2};
{layerFunction, layerFunction, layerFunction};
{layerMaterial, layerMaterial, layerMaterial};
# ----------------------------------------
byLayerProperties = Synthetic.Revit.CompoundStructure.ByLayerProperties(code_block_9.out0, code_block_9.out1, code_block_9.out2)

# group: MONITOR
watch_8 = Watch(byLayerProperties)
