# Dynamo graph Example CompoundStructure.dyn (Dynamo 1.3.0.875)

wall_types = WallTypes("Interior - 4 7/8\" Partition (1-hr)")
fromWallType = Synthetic.Revit.CompoundStructure.FromWallType(wall_types)
watch = Watch(fromWallType)
byLayerProperties = Synthetic.Revit.CompoundStructure.ByLayerProperties()  # unwired: arg0, arg1, arg2
watch_2 = Watch(byLayerProperties)
layerByList = Synthetic.Revit.CompoundStructure.LayerByList()  # unwired: arg0, arg1, arg2
toWall = Synthetic.Revit.CompoundStructure.ToWall(arg1=byLayerProperties)  # unwired: arg0
watch_3 = Watch(toWall)
element_types = ElementTypes("Material")
filterElementClass = Synthetic.Revit.Collector.FilterElementClass(element_types)
byFilters = Synthetic.Revit.Collector.ByFilters(filterElementClass)
toElements = Synthetic.Revit.Collector.ToElements(byFilters)
python_script = Python(IN[0]=toElements)
# ---------- python_script.python (10 lines) ----------
import clr
# Import ToDSType(bool) extension method
clr.AddReference("RevitNodes")
import Revit
clr.ImportExtensions(Revit.Elements)
#The inputs to this node will be stored as a list in the IN variables.


#Assign your output to the OUT variable.
OUT = IN[0][0].InternalElement
# ----------------------------------------
typeOf = Synthetic.Core.Object.TypeOf(python_script)
watch_4 = Watch()  # unwired: arg0
watch_5 = Watch()  # unwired: arg0
number_slider = DoubleSlider(1, range=0..5 step 1)
number_from_feet_and_inches = LengthFromString(0.3048)
setLayerWidth = Synthetic.Revit.CompoundStructure.SetLayerWidth(fromWallType, number_slider, number_from_feet_and_inches)
getLayers = Synthetic.Revit.CompoundStructure.GetLayers(setLayerWidth)
watch_6 = Watch(getLayers)
deleteLayer = Synthetic.Revit.CompoundStructure.DeleteLayer()  # unwired: arg0, arg1
getFirstCoreLayerIndex = Synthetic.Revit.CompoundStructure.GetFirstCoreLayerIndex(fromWallType)
getLastCoreLayerIndex = Synthetic.Revit.CompoundStructure.GetLastCoreLayerIndex(fromWallType)
wall_types_2 = WallTypes("Generic - 8\"")
toWallType = Synthetic.Revit.CompoundStructure.ToWallType(wall_types_2)  # unwired: arg1
toWallType_2 = Synthetic.Revit.CompoundStructure.ToWallType(wall_types, setLayerWidth)
