# Dynamo graph Example Input.TaskDialog.dyn (Dynamo 1.2.1.3083)

# group: INPUT
# note: Text to display in the dialog box.
string = StringInput("Test Title")
string_2 = StringInput("Test Instructions")
string_3 = StringInput("Test Content")
string_4 = StringInput("Test Footer")

# group: INPUT
# note: Command Link Names.  Can add up to (4) command links.
string_5 = StringInput("Test command 1")
string_6 = StringInput("Test command 2")
string_7 = StringInput("Test command 3")
string_8 = StringInput("Test command 4")

# group: INPUT
# note: You can pass functions to the dialog box!  The chosen function will be returned from the dialog box.
firstItem = List.FirstItem()  # unwired: arg0
count = Count()  # unwired: arg0

# group: INPUT: RESET
# note: Reset the Dialog so it will run again.
boolean = BoolSelector(false)

# group: OPERATIONS
code_block = CodeBlock { {1..5}; }
create = List.Create(string_5, string_6)
create_2 = List.Create(firstItem, count)
# note: Package: Synthetic
dialogTask = Synthetic.Revit.Input.DialogTask(string, string_2, string_3, string_4, create, create_2, boolean)
# note: Apply the returned function to a list.
map = List.Map(list=code_block, f_x=dialogTask)

# group: WATCH
watch = Watch(map)
