# Dynamo graph Example RevitDocuments.dyn (Dynamo 1.2.1.3083)

current = Synthetic.Revit.Document.Current()
watch = Watch(current)
getAllOpen = Synthetic.Revit.Document.GetAllOpen()
watch_2 = Watch(getAllOpen)
watch_3 = Watch()  # unwired: arg0
watch_4 = Watch()  # unwired: arg0
title = Synthetic.Revit.Document.Title(current)
watch_5 = Watch(title)
