# Dynamo graph Example UI.Dialogs.dyn (Dynamo 1.2.1.3083)

string = StringInput("Text (*.txt)|*.txt|All Files (*.*)|*.*")
boolean = BoolSelector(true)
boolean_2 = BoolSelector(true)
fileOpen = Synthetic.UI.DialogOS.FileOpen(string, boolean, boolean_2)
watch = Watch(fileOpen)
string_2 = StringInput("Open Dialog: Pick a test file")
string_3 = StringInput("Text (*.txt)|*.txt|All Files (*.*)|*.*")
boolean_3 = BoolSelector(true)
fileOpen_2 = Synthetic.UI.DialogRevit.FileOpen(string_2, string_3, boolean_3)
watch_2 = Watch(fileOpen_2)
string_4 = StringInput("Save Dialog: Pick a test file")
string_5 = StringInput("Text (*.txt)|*.txt|All Files (*.*)|*.*")
boolean_4 = BoolSelector(true)
fileSave = Synthetic.UI.DialogRevit.FileSave(string_4, string_5, boolean_4)
watch_3 = Watch(fileSave)
