# Dynamo graph Example UI.TaskDialog.dyn (Dynamo 1.2.1.3083)

# group: INPUT
string = StringInput("Test Title")
boolean = BoolSelector(true)
code_block = CodeBlock { "Command 1"; "Command 2"; "Command 3"; }
boolean_2 = BoolSelector(true)

byTitle = Synthetic.UI.DialogRevitTask.ByTitle(string)

# group: OPERATIONS
specifyButtons = Synthetic.UI.DialogRevitTask.SpecifyButtons(arg2=boolean, arg3=boolean)
addCommonButtons = Synthetic.UI.DialogRevitTask.AddCommonButtons(byTitle, specifyButtons)
specifyCommandLinks = Synthetic.UI.DialogRevitTask.SpecifyCommandLinks(code_block.out0, code_block.out1, code_block.out2)
code_block_2 = CodeBlock()
# ---------- code_block_2.designscript (11 lines) ----------
"Result None";
"Result Ok";
"Result Cancel";
"Result Retry";
"Result Yes";
"Result No";
"Result Close";
"Result CommandLink1";
"Result CommandLink2";
"Result CommandLink3";
"Resultn CommandLink4";
# ----------------------------------------
specifyResults = Synthetic.UI.DialogRevitTask.SpecifyResults(code_block_2.out0, code_block_2.out1, code_block_2.out2, code_block_2.out3, code_block_2.out4, code_block_2.out5, code_block_2.out6, code_block_2.out7, code_block_2.out8, code_block_2.out9, code_block_2.out10)

addCommandLinks = Synthetic.UI.DialogRevitTask.AddCommandLinks(addCommonButtons, specifyCommandLinks)

# group (continued): OPERATIONS
show = Synthetic.UI.DialogRevitTask.Show(addCommandLinks, boolean_2)
filterResults = Synthetic.UI.DialogRevitTask.FilterResults(show, specifyResults)

# group: MONITOR
watch = Watch(show)
watch_2 = Watch(filterResults)

# group: OPERATIONS
taskDialogResults = Synthetic.UI.DialogRevitTask.TaskDialogResults()
getValue = Synthetic.Core.Enumeration.GetValue(taskDialogResults)

# group: MONITOR
watch_3 = Watch(taskDialogResults)
watch_4 = Watch(getValue)

# group: OPERATIONS
taskDialogCommonButtons = Synthetic.UI.DialogRevitTask.TaskDialogCommonButtons()
getValue_2 = Synthetic.Core.Enumeration.GetValue(taskDialogCommonButtons)

# group: MONITOR
watch_5 = Watch(taskDialogCommonButtons)
watch_6 = Watch(getValue_2)

# group: OPERATIONS
taskDialogCommandLinkId = Synthetic.UI.DialogRevitTask.TaskDialogCommandLinkId()
getValue_3 = Synthetic.Core.Enumeration.GetValue(taskDialogCommandLinkId)

# group: MONITOR
watch_7 = Watch(getValue_3)
watch_8 = Watch(taskDialogCommandLinkId)

# group: INPUT
string_2 = StringInput("Test Title")
boolean_3 = BoolSelector(true)
code_block_3 = CodeBlock { "First Item Of"; "Count"; "Shuffle List"; }
code_block_4 = CodeBlock()  # same code as code_block_2
# note: One can pass functions as possible results.
firstItem = List.FirstItem()  # unwired: arg0
count = List.Count()  # unwired: arg0
shuffle = List.Shuffle()  # unwired: arg0
boolean_4 = BoolSelector(true)

# group: OPERATIONS
specifyButtons_2 = Synthetic.UI.DialogRevitTask.SpecifyButtons(arg6=boolean_3)
specifyCommandLinks_2 = Synthetic.UI.DialogRevitTask.SpecifyCommandLinks(code_block_3.out0, code_block_3.out1, code_block_3.out2)
specifyResults_2 = Synthetic.UI.DialogRevitTask.SpecifyResults(code_block_4.out0, code_block_4.out1, code_block_4.out2, code_block_4.out3, code_block_4.out4, code_block_4.out5, code_block_4.out6, firstItem, count, shuffle)
byAllProperties = Synthetic.UI.DialogRevitTask.ByAllProperties(string_2, arg4=specifyButtons_2, arg5=specifyCommandLinks_2, arg6=specifyResults_2, arg7=boolean_4)
code_block_5 = CodeBlock { {1..10}; }
# note: If one evaluates the function with Function.Apply, each item in the list is evaluated indvidually.
apply = ApplyFunction(byAllProperties, code_block_5)  # "Function.Apply"
# note: If one evaluates the results with a List.Map, the functions are applied to the overall list, not the individual items.
map = List.Map(list=code_block_5, f_x=byAllProperties)

# group: MONITOR
watch_9 = Watch(byAllProperties)
watch_10 = Watch(apply)
watch_11 = Watch(map)

# group: INPUT
string_3 = StringInput("Test Title")
string_4 = StringInput("Instructions go here")
string_5 = StringInput("Content goes here")
string_6 = StringInput("Footer text goes here")
boolean_5 = BoolSelector(true)

# group: OPERATIONS
byAllProperties_2 = Synthetic.UI.DialogRevitTask.ByAllProperties(string_3, string_4, string_5, string_6, arg7=boolean_5)

watch_12 = Watch(byAllProperties_2)
