# Dynamo graph Example Workset Unwrap.dyn (Dynamo 1.2.1.3083)

# group: INSTRUCTIONS
# note: Example of unwrapping a workset so one can use the workset in Python scripts.

# group: INPUT
# note: Name of workset in the project.
string = StringInput("Workset1")

# group: OPERATIONS
string_2 = StringInput("""import clr

#Add a reference and import Synthetic's workset library.
clr.AddReference('Synthetic.Revit')
from Synthetic.Revit import *

#INPUT
workset = IN[0]

#OUTPUT: Use the workset instance to access the static Unwrap method
OUT = workset.Unwrap(workset)""")
getByName = Synthetic.Revit.Workset.GetByName(string)
python_script_from_string = PythonStringNode(script=string_2, IN[0]=getByName)
unwrap = Synthetic.Revit.Workset.Unwrap(getByName)

# group: MONITOR
watch = Watch(python_script_from_string)
watch_2 = Watch(unwrap)
