# Dynamo graph Example Assemblies.dyn (Dynamo 1.3.2.2480)

# group: INPUT
# note: Searches Assemblies for Assembly names that contain this string
code_block = CodeBlock { "Synthetic"; }
# note: Destination Directory for icon images
directory_path = Directory("D:\Dropbox\Projects\Revit Dynamo Synthetic R2\Images Synthetic\Methods")
# note: Small Icon File Path
file_path = Filename("..\..\..\..\Images Synthetic\Synthetic.Small.png")
# note: Large Icon File Path
file_path_2 = Filename("..\..\..\..\Images Synthetic\Synthetic.Large.png")
# note: IF True => Excute copying files
# ELSE => Do not copy files
boolean = BoolSelector(false)

# group: OPERATION: Get Assemblies
getAssemblies = Synthetic.Core.Assemblies.GetAssemblies()
code_block_2 = CodeBlock(assemblyContains=code_block) { assemblyContains; }
keyContains = Synthetic.Core.Dictionary.KeyContains(getAssemblies, code_block_2)

# group: OPERATION: Get Methods
getTypes = Synthetic.Core.Assemblies.GetTypes(keyContains)
getPublicStaticMethods = Synthetic.Core.Assemblies.GetPublicStaticMethods(getTypes)
flatten = Flatten(getPublicStaticMethods)
code_block_3 = CodeBlock(methodNames=flatten) { methodNames; }

# group: MONITOR
watch = Watch(code_block_3)

# group: MONITOR
fullName = Synthetic.Core.Assemblies.FullName(keyContains)
watch_2 = Watch(fullName)

# group: OPERATION: Prepare DestinationPath
string = StringInput("\")
code_block_4 = CodeBlock(destinationPath=directory_path, sep=string) { {destinationPath, sep}; }
concat = String.Concat(code_block_4)
code_block_5 = CodeBlock(l=concat) { l[0]; }

# group: OPERATION: Get File Extensions of Default Icons
code_block_6 = CodeBlock(filePathSmall=file_path, filePathLarge=file_path_2) { {filePathSmall, filePathLarge}; }
extension = FilePath.Extension(code_block_6)
code_block_7 = CodeBlock(extensions=extension) { extensions[0]; extensions[1]; }

# group: OPERATION: Create lists of icons names
code_block_8 = CodeBlock { ".Small"; ".Large"; }
code_block_9 = CodeBlock(methodNames=code_block_3, destinationPath=code_block_5, small=code_block_8.out0, smallExtension=code_block_7.out0, large=code_block_8.out1, largeExtension=code_block_7.out1)
# ---------- code_block_9.designscript (7 lines) ----------
methodNames;
count = List.Count(methodNames);
List.Cycle({destinationPath}, count);
List.Cycle({small}, count);
List.Cycle({smallExtension}, count);
List.Cycle({large}, count);
List.Cycle({largeExtension}, count);
# ----------------------------------------
create = List.Create(code_block_9.out2, code_block_9.methodNames, code_block_9.out3, code_block_9.out4)
transpose = List.Transpose(create)
create_2 = List.Create(code_block_9.out2, code_block_9.methodNames, code_block_9.out5, code_block_9.out6)
transpose_2 = List.Transpose(create_2)
concat_2 = String.Concat(transpose, transpose_2)

# group: MONITOR
watch_3 = Watch(concat_2)

# group: OPERATION: Copy Icon files
code_block_10 = CodeBlock(executeCopy=boolean, filePathSmall=file_path, filePathLarge=file_path_2, destinationPaths=concat_2) { executeCopy; {filePathSmall,filePathLarge}; destinationPaths; }
code_block_11 = CodeBlock { null; }
# note: Get File from Path
# note: IF true => Execute coping files
# ELSE => Do not copy files
if_ = If(test=code_block_10.executeCopy, true=code_block_10.out1, false=code_block_11)
# note: Overwrite Previous Icons
boolean_2 = BoolSelector(true)

fromPath = FileObject(if_)  # "File.FromPath"

# group (continued): OPERATION: Copy Icon files
# note: Copy files
copy = File.Copy(fromPath, code_block_10.destinationPaths, boolean_2, lacing=Longest)

# group: MONITOR
watch_4 = Watch(copy)
