# Dynamo graph Example CompoundStructure FromWallTypes.dyn (Dynamo 1.3.2.2480)

element_types = ElementTypes("WallType")
filterElementClass = Synthetic.Revit.CollectorElementFilter.FilterElementClass(element_types)
byFilters = Synthetic.Revit.Collector.ByFilters(filterElementClass)
toElements = Synthetic.Revit.Collector.ToElements(byFilters)
watch = Watch(toElements)
fromWallType = Synthetic.Revit.CompoundStructure.FromWallType(toElements)
watch_2 = Watch(fromWallType)
typeOf = Synthetic.Core.Object.TypeOf(toElements)
watch_3 = Watch(typeOf)
wall_types = WallTypes("Exterior - Brick and CMU on MTL. Stud")
fromWallType_2 = Synthetic.Revit.CompoundStructure.FromWallType(wall_types)
watch_4 = Watch(fromWallType_2)
typeOf_2 = Synthetic.Core.Object.TypeOf(wall_types)
watch_5 = Watch(typeOf_2)
