# Dynamo graph Example CompoundStructure Sync Docs.dyn (Dynamo 1.3.0.875)

element_types = ElementTypes("WallType")
filterElementClass = Synthetic.Revit.Collector.FilterElementClass(element_types)
# note: Source document
file_path = Filename("..\..\..\Testing\Sync Wall Types\Test Sync Wall Types Source.rvt")
boolean = BoolSelector(false)
open = Synthetic.Revit.Document.Open(file_path, boolean)
# note: Target Document is the current document
current = Synthetic.Revit.Document.Current()
create = List.Create(open, current)
code_block = CodeBlock(documents=create) { documents; }
byFilters = Synthetic.Revit.Collector.ByFilters(filterElementClass, code_block)
toElements = Synthetic.Revit.Collector.ToElements(byFilters)
code_block_2 = CodeBlock { "Type Name"; }
wall_types = WallTypes("Generic - 8\"")
name = Element.Name(wall_types)
filterByParameterValue = Synthetic.Revit.Elements.FilterByParameterValue(toElements, code_block_2, name)
filterByBoolMask = List.FilterByBoolMask(list=toElements, mask=filterByParameterValue)
watch = Watch(filterByBoolMask.in)
# note: If TRUE, modify wall in target document.  ELSE do not proceed.
boolean_2 = BoolSelector(true)
code_block_3 = CodeBlock(list=filterByBoolMask.in) { list[0]; DSCore.List.RestOfItems(list); }
code_block_4 = CodeBlock(proceed=boolean_2, wallSource=code_block_3.out0, documentSource=open, wallTarget=code_block_3.out1, documentTarget=current) { proceed; wallSource; documentSource; wallTarget; documentTarget; }
code_block_5 = CodeBlock { null; }
if_ = If(test=code_block_4.proceed, true=code_block_4.wallTarget, false=code_block_5)
# note: Get the CompoundStructure of the Source Wall
fromWallType = Synthetic.Revit.CompoundStructure.FromWallType(code_block_4.wallSource, code_block_4.documentSource)
copyToDocument = Synthetic.Revit.CompoundStructure.CopyToDocument(fromWallType, code_block_4.documentTarget)
toWallType = Synthetic.Revit.CompoundStructure.ToWallType(if_, copyToDocument)
fromWallType_2 = Synthetic.Revit.CompoundStructure.FromWallType(toWallType, code_block_4.documentTarget)
watch_2 = Watch(fromWallType_2)
# note: If True, close the source document.  This will save any changes.
boolean_3 = BoolSelector(false)
code_block_6 = CodeBlock { null; }
if_2 = If(test=boolean_3, true=code_block_4.documentSource, false=code_block_6)
boolean_4 = BoolSelector(false)
close = Synthetic.Revit.Document.Close(if_2, boolean_4)
watch_3 = Watch(fromWallType)
