# Dynamo graph Example CopyElementsBetweenDocs.dyn (Dynamo 1.2.1.3083)

# group: SMPC DYNAMO LIBRARY DEFINITION INFORMATION ---------------------------------------------------------------
# note: INSTRUCTIONS:
# Instructions go here.
# note: COPYRIGHT:
# The MIT LICENSE (MIT):
# Copyright (c) 2016 Arthur McGoey
# Permission is hereby granted, free of charge, to any person obtaining a copy of this software and associated documentation files (the "Software"), to deal in the Software without restriction, including without limitation the rights to use, copy, modify, merge, publish, distribute, sublicense, and/or sell copies of the Software, and to permit persons to whom the Software is furnished to do so, subject to the following conditions:
# The above copyright notice and this permission notice shall be included in all copies or substantial portions of the Software.
# THE SOFTWARE IS PROVIDED "AS IS", WITHOUT WARRANTY OF ANY KIND, EXPRESS OR IMPLIED, INCLUDING BUT NOT LIMITED TO THE WARRANTIES OF MERCHANTABILITY, FITNESS FOR A PARTICULAR PURPOSE AND NONINFRINGEMENT. IN NO EVENT SHALL THE AUTHORS OR COPYRIGHT HOLDERS BE LIABLE FOR ANY CLAIM, DAMAGES OR OTHER LIABILITY, WHETHER IN AN ACTION OF CONTRACT, TORT OR OTHERWISE, ARISING FROM, OUT OF OR IN CONNECTION WITH THE SOFTWARE OR THE USE OR OTHER DEALINGS IN THE SOFTWARE.
# note: DESCRIPTION:
# General script definition goes here
# note: AUTHOR & CONTRIBUTORS:
# DATE:
# 2016-09-01
# AUTHOR:
# Stuart Chen Knight-Williamson
# CONTRIBUTORS:
# Arthur McGoey
# DEFINITION VERSION:
# 1.0
# note: VERSIONS AND COMPATIBILITY
# REVIT:
# Revit 2017
# DYNAMO:
# Dynamo 1.1
# OTHER:
# note: DYNAMO PACKAGE DEPENDENCIES:
# list all required packages here, also leave notes over nodes from specialty packages
# note: NOTES:

# group: INPUTS
# note: INPUTS

# group: OPERATIONS
# note: OPERATIONS

# group: OUTPUTS
# note: OUTPUTS

# group: WATCHING
# note: WATCHING

# group: HELP & INFO
# note: HELP & INFO

# group: INPUTS
# note: Model Element to copy its type
select_model_element = DSModelElementSelection()  # 1 picked in the model

# group: OPERATIONS
current = Synthetic.Revit.Document.Current()
string = StringInput("Type")
getParameterValueByName = Element.GetParameterValueByName(element=select_model_element, parameterName=string)
id = Element.Id(getParameterValueByName)
getAllOpen = Synthetic.Revit.Document.GetAllOpen()
code_block = CodeBlock(l=getAllOpen) { l[0]; l[1]; }
copyElementsBetweenDocs = Synthetic.Revit.Elements.CopyElementsBetweenDocs(current, id, code_block.out0)
