# Dynamo graph Example Deserialize Elements to JSON.dyn (Dynamo 2.0.3.8810)

# group: INPUT
# note: Path to json file.
file_path = Filename("G:\My Drive\Assets\!Revit Experiments\Serialize JSON\Serialize TextNoteTypes.json")
# note: TRUE -> Create and Modify Elements
# FALSE -> Read file only
boolean = BoolSelector(false)
# note: Type of Template Element
element_types = ElementTypes(index=320)

# group: OPERATION: Create SerialElements
readText = FileSystem.ReadText(file=file_path)
# note: Custom Node: Synthetic
#    v. 1.3.190629
deserializeListByJson = Synthetic.Serialize.Revit.SerializeJSON.DeserializeListByJson(Json=readText)

# group: WATCH: JSON
watch = Watch(readText)

# group: WATCH: SerialElements
watch_2 = Watch(deserializeListByJson)

# group: OPERATION: Get a template element
# note: Custom Node: Synthetic
#    v. 1.3.190629
filterElementClass = Synthetic.Revit.CollectorElementFilter.FilterElementClass(type=element_types)
byFilters = Synthetic.Revit.Collector.ByFilters(filters=filterElementClass)
toElements = Synthetic.Revit.Collector.ToElements(collector=byFilters)
code_block = CodeBlock(l=toElements) { l[1]; }

# group: OPERATIONS: Make new ElementTypes or modify existing ElementTypes
code_block_2 = CodeBlock(execute=boolean, serialElements=deserializeListByJson, templateElement=code_block) { execute; serialElements; templateElement; }
# note: Custom Node: Synthetic
#    v. 1.3.190629
createElementType = Synthetic.Serialize.Revit.SerializeJSON.CreateElementType(templateType=code_block_2.templateElement)  # unwired: serialElementType
start = Revit.Transaction.Transaction.Start(input=createElementType)
code_block_3 = CodeBlock { null; }
if_ = If(test=code_block_2.execute, true=code_block_2.serialElements, false=code_block_3)
function_apply = ApplyFunction(func=start, arg1=if_)
end = Revit.Transaction.Transaction.End(input=function_apply)

# group: WATCH: New Elements
name = Element.Name(element=function_apply)
watch_3 = Watch(name)
