# Dynamo graph Example Dictionary.dyn (Dynamo 1.2.1.3083)

# group: DEFINITION INFORMATION ---------------------------------------------------------------
# note: AUTHOR & CONTRIBUTORS:
# DATE:
# 2016-12-03
# AUTHOR:
# Arthur McGoey
# CONTRIBUTORS:
# DEFINITION VERSION:
# 1.0
# note: COPYRIGHT:
# The MIT LICENSE (MIT):
# Copyright (c) 2016 Arthur McGoey
# Permission is hereby granted, free of charge, to any person obtaining a copy of this software and associated documentation files (the "Software"), to deal in the Software without restriction, including without limitation the rights to use, copy, modify, merge, publish, distribute, sublicense, and/or sell copies of the Software, and to permit persons to whom the Software is furnished to do so, subject to the following conditions:
# The above copyright notice and this permission notice shall be included in all copies or substantial portions of the Software.
# THE SOFTWARE IS PROVIDED "AS IS", WITHOUT WARRANTY OF ANY KIND, EXPRESS OR IMPLIED, INCLUDING BUT NOT LIMITED TO THE WARRANTIES OF MERCHANTABILITY, FITNESS FOR A PARTICULAR PURPOSE AND NONINFRINGEMENT. IN NO EVENT SHALL THE AUTHORS OR COPYRIGHT HOLDERS BE LIABLE FOR ANY CLAIM, DAMAGES OR OTHER LIABILITY, WHETHER IN AN ACTION OF CONTRACT, TORT OR OTHERWISE, ARISING FROM, OUT OF OR IN CONNECTION WITH THE SOFTWARE OR THE USE OR OTHER DEALINGS IN THE SOFTWARE.
# note: INSTRUCTIONS:
# None.
# note: VERSIONS AND COMPATIBILITY
# REVIT:
# N/A
# DYNAMO:
# Dynamo 1.2
# OTHER:
# note: DYNAMO PACKAGE DEPENDENCIES:
# Synthetic
# note: NOTES:
# note: DESCRIPTION:
# Examples showing the usage of the Synthetic.Core.Dictionary nodes.

# group: HELP & INFO
# note: HELP & INFO

# group: OUTPUTS
# note: OUTPUTS

# group: WATCHING
# note: WATCHING

# group: OPERATIONS
# note: OPERATIONS

# group: INPUTS
# note: INPUTS

# group: Input
# note: Keys
code_block = CodeBlock { {"Test1", "Test2","Test3"}; }
# note: Values
code_block_2 = CodeBlock { {99, 11, 44}; }
# note: Example Key
string = StringInput("Test1")
# note: Key-Value Pair
code_block_3 = CodeBlock { {"Added", 33}; }
# note: Key and Value
code_block_4 = CodeBlock { "Test1"; 999; }

# group: OPERATIONS
# note: Exampe: Get a specific value using a key.
byKeysValues = Synthetic.Core.Dictionary.ByKeysValues(code_block, code_block_2)
getKeys = Synthetic.Core.Dictionary.GetKeys(byKeysValues)
code_block_5 = CodeBlock(l=getKeys) { l[1]; }
value = Synthetic.Core.Dictionary.Value(byKeysValues, code_block_5)

# group: MONITOR
watch = Watch(byKeysValues)
watch_2 = Watch(value)

# group: OPERATIONS
# note: Example of creating a Dictionary by a list of key-value pair lists
code_block_6 = CodeBlock(l1=code_block, l2=code_block_2) { List.Transpose({l1,l2}); }
byKeyValuePairs = Synthetic.Core.Dictionary.ByKeyValuePairs(code_block_6)
getKeyValuePairs = Synthetic.Core.Dictionary.GetKeyValuePairs(byKeyValuePairs)

# group: MONITOR
watch_3 = Watch(getKeyValuePairs)
watch_4 = Watch(byKeyValuePairs)
watch_5 = Watch(code_block_6)

# group: OPERATIONS
# note: Exampe: Make a Dictionary from two lists, Keys & Values.  List out all Values and Keys.
byKeysValues_2 = Synthetic.Core.Dictionary.ByKeysValues(code_block, code_block_2)
getValues = Synthetic.Core.Dictionary.GetValues(byKeysValues_2)
getKeys_2 = Synthetic.Core.Dictionary.GetKeys(byKeysValues_2)

# group: MONITOR
watch_6 = Watch(getValues)
watch_7 = Watch(getKeys_2)

# group: OPERATIONS
# note: Example: Shows how to unwrap the dictionary into is basic data type.
byKeysValues_3 = Synthetic.Core.Dictionary.ByKeysValues(code_block, code_block_2)
unwrap = Synthetic.Core.Dictionary.Unwrap(byKeysValues_3)
wrap = Synthetic.Core.Dictionary.Wrap(unwrap)

# group: MONITOR
watch_8 = Watch(wrap)
watch_9 = Watch(unwrap)

# group: OPERATIONS
# note: Example: After unwrapping, one can use Core Dynamo nodes to extract values from the dictionary.  Dynamo seems to display the .NET Dictionary as a list, but the keys are still accessible.
byKeysValues_4 = Synthetic.Core.Dictionary.ByKeysValues(code_block, code_block_2)
unwrap_2 = Synthetic.Core.Dictionary.Unwrap(byKeysValues_4)
getValues_2 = GetValues(unwrap_2)
getKeys_3 = GetKeys(unwrap_2)
code_block_7 = CodeBlock(s=string) { s; }
containsKey = ContainsKey(unwrap_2, code_block_7)

# group: MONITOR
watch_10 = Watch(getValues_2)
watch_11 = Watch(getKeys_3)
watch_12 = Watch(containsKey)

# group: OPERATIONS
# note: Example: Adding and removing Key-Value pairs to a dictionary.
byKeysValues_5 = Synthetic.Core.Dictionary.ByKeysValues(code_block, code_block_2)
code_block_8 = CodeBlock(kvp=code_block_3) { kvp[0]; kvp[1]; }
add = Synthetic.Core.Dictionary.Add(byKeysValues_5, code_block_8.out0, code_block_8.out1)
getKeyValuePairs_2 = Synthetic.Core.Dictionary.GetKeyValuePairs(add)
code_block_9 = CodeBlock(s=string) { s; }
remove = Synthetic.Core.Dictionary.Remove(add, code_block_9)
getKeyValuePairs_3 = Synthetic.Core.Dictionary.GetKeyValuePairs(remove)

# group: MONITOR
watch_13 = Watch(getKeyValuePairs_2)
watch_14 = Watch(remove)
watch_15 = Watch(getKeyValuePairs_3)

byKeysValues_6 = Synthetic.Core.Dictionary.ByKeysValues(code_block, code_block_2)
setValueAtKey = Synthetic.Core.Dictionary.SetValueAtKey(byKeysValues_6, code_block_4.out0, code_block_4.out1)

# group: MONITOR
watch_16 = Watch(setValueAtKey)
