# Dynamo graph Example Document AuditProjectFamilies.dyn (Dynamo 2.2.1.5175)

current = Synthetic.Revit.Document.Current()
boolean = BoolSelector(true)
auditProjectFamilies = Synthetic.Revit.Document.AuditProjectFamilies(document=current, execute=boolean)
watch = Watch(auditProjectFamilies)
