# Dynamo graph Example Duplicate Views Per Design Option.dyn (Dynamo 1.3.2.2480)

element_types = ElementTypes("DesignOption")
filterElementClass = Synthetic.Revit.CollectorElementFilter.FilterElementClass(element_types)
byFilters = Synthetic.Revit.Collector.ByFilters(filterElementClass)
toElements = Synthetic.Revit.Collector.ToElements(byFilters)
name = Element.Name(toElements)
watch = Watch(name)
element_types_2 = ElementTypes("View3D")
filterElementClass_2 = Synthetic.Revit.CollectorElementFilter.FilterElementClass(element_types_2)
byFilters_2 = Synthetic.Revit.Collector.ByFilters(filterElementClass_2)
string = StringInput("Daylighting Plan")
queryNameContains = Synthetic.Revit.Collector.QueryNameContains(byFilters_2, string)
watch_2 = Watch(queryNameContains)
string_2 = StringInput(" ")
name_2 = Element.Name(queryNameContains)
count = List.Count(name_2)
cycle = List.Cycle(list=name, amount=count)
sort = List.Sort(cycle)
count_2 = List.Count(name)
cycle_2 = List.Cycle(list=name_2, amount=count_2)
create = List.Create(sort, cycle_2)
transpose = List.Transpose(create@L3, lacing=CrossProduct)
join = String.Join(string_2, transpose)
sort_2 = List.Sort(join)
watch_3 = Watch(sort_2)
watch_4 = Watch(transpose)
watch_5 = Watch(join)
flatten = Flatten(join)
code_block = CodeBlock { 0..8; 9; }
sublists = List.Sublists(list=flatten, ranges=code_block.out0, offset=code_block.out1)
transpose_2 = List.Transpose(sublists)
watch_6 = Watch(transpose_2)
viewDuplicateOption = DropDownViewDuplicateOption("WithDetailing")
duplicateView = Synthetic.Revit.View.DuplicateView(transpose_2, queryNameContains, viewDuplicateOption)
watch_7 = Watch(duplicateView)
