# Dynamo graph Example ElementTypes Merge.dyn "Example TextNoteTypes Merge" (Dynamo 2.0.2.6826)

# group: INFO: Excel Format
# note: 1ST COLUMN -> These ElementTypes will be merged into 2ND COLUMN.
# 2ND COLUMN -> ElementTypes to be merged into.
# 3RD COLUMN -> Revit API Class of the ElementType.  For example, Autodesk.Revit.DB.TextNoteType or Autodesk.Revit.DB.WallType.

# group: INPUT
# note: Path to Excel file
file_path_excel_file = Filename("..\..\..\..\Testing\ElementTypes Merge\Merge Types.xlsx")
# note: Name of Sheet in Excel
string_excel_sheet_name = StringInput("Sheet1")
# note: TRUE -> Show Excel
# FALSE -> Hide Excel
boolean_show_excel = BoolSelector(true)

# group: OPERATION: Import Data from Excel
file_from_path = FileObject(path=file_path_excel_file)
importExcel = Data.ImportExcel(file=file_from_path, sheetName=string_excel_sheet_name, showExcel=boolean_show_excel)
transpose = List.Transpose(lists=importExcel)
code_block = CodeBlock(l=transpose) { l[0]; l[1]; l[2]; }

# group: OPERATION: Select ElementTypes and Merge
# note: PACKAGE: Synthetic
revitClassByString = Synthetic.Revit.Tools.RevitClassByString(typeName=code_block.out2)
dynamoElementByNameClass = Synthetic.Revit.Select.DynamoElementByNameClass(Name=code_block.out0, Class=revitClassByString)
dynamoElementByNameClass_2 = Synthetic.Revit.Select.DynamoElementByNameClass(Name=code_block.out1, Class=revitClassByString)
mergeElementTypes = Synthetic.Revit.Elements.MergeElementTypes(FromType=dynamoElementByNameClass, ToType=dynamoElementByNameClass_2)

# group: WATCH: Element Instances that failed to merge
name = Element.Name(element=mergeElementTypes.Failed)
watch = Watch(name)

# group: WATCH: Merged Element Instances
name_2 = Element.Name(element=mergeElementTypes.Elements_Merged)
watch_2 = Watch(name_2)
