# Dynamo graph Example ElementTypes Merge2.dyn "Example TextNoteTypes Merge2" (Dynamo 2.0.2.6826)

# group: INPUT
string = StringInput("1/4\" Arial")
string_2 = StringInput("Schedule Default")
list_create = List.Create(item0=string, item1=string_2)
element_types = ElementTypes(index=320)
string_3 = StringInput("3/32\" Arial")

# group: OPERATION: Select TextNoteTypes and Merge
dynamoElementByNameClass = Synthetic.Revit.Select.DynamoElementByNameClass(Name=list_create, Class=element_types)
dynamoElementByNameClass_2 = Synthetic.Revit.Select.DynamoElementByNameClass(Name=string_3, Class=element_types)
mergeElementTypes = Synthetic.Revit.Elements.MergeElementTypes(FromType=dynamoElementByNameClass, ToType=dynamoElementByNameClass_2)

# group: WATCH: Merged TextNote Instances
name = Element.Name(element=mergeElementTypes.Elements_Merged)
watch = Watch(name)

# group: WATCH: TextNote Instances that failed to merge
name_2 = Element.Name(element=mergeElementTypes.Failed)
watch_2 = Watch(name_2)

# group: INPUT
string_4 = StringInput("Test 1")
string_5 = StringInput("Test 2")
list_create_2 = List.Create(item0=string_4, item1=string_5)
element_types_2 = ElementTypes(index=76)
string_6 = StringInput("Linear - 3/32\" Arial")

# group: OPERATION: Select TextNoteTypes and Merge
dynamoElementByNameClass_3 = Synthetic.Revit.Select.DynamoElementByNameClass(Name=list_create_2, Class=element_types_2)
dynamoElementByNameClass_4 = Synthetic.Revit.Select.DynamoElementByNameClass(Name=string_6, Class=element_types_2)
mergeElementTypes_2 = Synthetic.Revit.Elements.MergeElementTypes(FromType=dynamoElementByNameClass_3, ToType=dynamoElementByNameClass_4)

# group: WATCH: TextNote Instances that failed to merge
name_3 = Element.Name(element=mergeElementTypes_2.Failed)
watch_3 = Watch(name_3)

# group: WATCH: Merged TextNote Instances
name_4 = Element.Name(element=mergeElementTypes_2.Elements_Merged)
watch_4 = Watch(name_4)

# group: INPUT
string_7 = StringInput("Generic - 5\"")
string_8 = StringInput("Generic - 12\"")
list_create_3 = List.Create(item0=string_7, item1=string_8)
element_types_3 = ElementTypes(index=345)
string_9 = StringInput("Generic - 8\"")

# group: OPERATION: Select TextNoteTypes and Merge
dynamoElementByNameClass_5 = Synthetic.Revit.Select.DynamoElementByNameClass(Name=list_create_3, Class=element_types_3)
dynamoElementByNameClass_6 = Synthetic.Revit.Select.DynamoElementByNameClass(Name=string_9, Class=element_types_3)
mergeElementTypes_3 = Synthetic.Revit.Elements.MergeElementTypes(FromType=dynamoElementByNameClass_5, ToType=dynamoElementByNameClass_6)

# group: WATCH: TextNote Instances that failed to merge
name_5 = Element.Name(element=mergeElementTypes_3.Failed)
watch_5 = Watch(name_5)

# group: WATCH: Merged TextNote Instances
name_6 = Element.Name(element=mergeElementTypes_3.Elements_Merged)
watch_6 = Watch(name_6)
