# Dynamo graph Example Enumeration.dyn (Dynamo 1.2.1.3083)

# group: INPUT
code_block = CodeBlock { "Autodesk.Revit.DB.MaterialFunctionAssignment"; {"Structure","Substrate","1","4","100"}; }

# group: OPERATIONS
parse = Synthetic.Core.Enumeration.Parse(code_block.out0, code_block.out1)
getEnumType = Synthetic.Core.Enumeration.GetEnumType(code_block.out0)
getEnums = Synthetic.Core.Enumeration.GetEnums(code_block.out0)
getValue = Synthetic.Core.Enumeration.GetValue(getEnums)
getNames = Synthetic.Core.Enumeration.GetNames(code_block.out0)

# group: MONITOR
watch = Watch(parse)
watch_2 = Watch(getEnumType)
watch_3 = Watch(getEnums)
watch_4 = Watch(getValue)
watch_5 = Watch(getNames)
