# Dynamo graph Example FilterElementParameterNumeric.dyn (Dynamo 1.3.2.2480)

# group: INPUT
element_types = ElementTypes("Level")
selectBuiltIn = DropDownBuiltInParameters("LEVEL_ELEV")  # "Parameters.SelectBuiltIn"
number = DoubleInput(5)
numericRules = FilterNumericRulesDropDown("Autodesk.Revit.DB.FilterNumericGreaterOrEqual")  # "FilterParameter.NumericRules"

# group: OPERATIONS
filterElementClass = Synthetic.Revit.CollectorElementFilter.FilterElementClass(element_types)
filterElementNumberParameter = Synthetic.Revit.CollectorElementFilter.FilterElementNumberParameter(selectBuiltIn, number, arg3=numericRules)
create = List.Create(filterElementClass, filterElementNumberParameter)
byFilters = Synthetic.Revit.Collector.ByFilters(create)
toElementIds = Synthetic.Revit.Collector.ToElementIds(byFilters)
toElements = Synthetic.Revit.Collector.ToElements(byFilters)

filterElementIntegerParameter = Synthetic.Revit.CollectorElementFilter.FilterElementIntegerParameter()  # unwired: arg0, arg1, arg2

# group: MONITOR
watch = Watch(toElements)

# group: MONITOR
string = StringInput("Elevation")
getParameterValueByName = Element.GetParameterValueByName(element=toElements, parameterName=string)
watch_2 = Watch(getParameterValueByName)

# group: INPUT
element_types_2 = ElementTypes("View")
selectBuiltIn_2 = DropDownBuiltInParameters("VIEW_TEMPLATE")  # "Parameters.SelectBuiltIn"
code_block = CodeBlock { "Architectural Plan"; }

# group: OPERATIONS
filterElementClass_2 = Synthetic.Revit.CollectorElementFilter.FilterElementClass(element_types_2)
getViewTemplateByName = Synthetic.Revit.ViewTemplate.GetViewTemplateByName(code_block)
id = Element.Id(getViewTemplateByName)
numericRules_2 = FilterNumericRulesDropDown("Autodesk.Revit.DB.FilterNumericEquals")  # "FilterParameter.NumericRules"
filterElementIdParameter = Synthetic.Revit.CollectorElementFilter.FilterElementIdParameter(selectBuiltIn_2, id, numericRules_2)
create_2 = List.Create(filterElementClass_2, filterElementIdParameter)
byFilters_2 = Synthetic.Revit.Collector.ByFilters(create_2)
toElements_2 = Synthetic.Revit.Collector.ToElements(byFilters_2)

# group: MONITOR
watch_3 = Watch(toElements_2)

string_2 = StringInput("Autodesk.Revit.DB.FilterNumericGreaterOrEqual")
filterNumericRules = Synthetic.Revit.CollectorFilterRules.FilterNumericRules(string_2)
