# Dynamo graph Example LineStyles Merge.dyn (Dynamo 2.2.1.5175)

# group: INFO: Excel Format
# note: 1ST COLUMN -> These Line Styles will be merged into 2ND COLUMN.
# 2ND COLUMN -> Line Styles to be merged into.

# group: INPUT
# note: IF TRUE: Execute MergeLineStyles.
# IF FALSE: Hold on execution
boolean = BoolSelector(true)
# note: Path to Excel file
file_path_excel_file = Filename("G:\My Drive\Assets\!Revit Experiments\ElementTypeMerge\LineStyles Merge.xlsx")
# note: Name of Sheet in Excel
string_excel_sheet_name = StringInput("Sheet1")
# note: TRUE -> Show Excel
# FALSE -> Hide Excel
boolean_show_excel = BoolSelector(true)

# group: OPERATION: Import Data from Excel
file_from_path = FileObject(path=file_path_excel_file)
importExcel = Data.ImportExcel(file=file_from_path, sheetName=string_excel_sheet_name, showExcel=boolean_show_excel)
transpose = List.Transpose(lists=importExcel)

# group: OPERATION: EXECUTE
code_block = CodeBlock { null; }
if_ = If(test=boolean, true=transpose, false=code_block)

# group (continued): OPERATION: Import Data from Excel
code_block_2 = CodeBlock(l=if_) { l[0]; l[1]; l[2]; }

# group: OPERATION: Select ElementTypes and Merge
# note: PACKAGE: Synthetic
mergeLineStyles = Synthetic.Revit.Lines.MergeLineStyles(FromLineStyle=code_block_2.out0, ToLineStyle=code_block_2.out1)

# group: WATCH: Element Instances that failed to merge
watch = Watch(mergeLineStyles.Failed)

# group: WATCH: Merged Element Instances
watch_2 = Watch(mergeLineStyles.Merged)

# group: WATCH: Data from Excel
watch_3 = Watch(transpose)
