# Dynamo graph Example Pick.Elements.dyn (Dynamo 1.2.1.3083)

# note: Status bar message
string = StringInput("Pick elements, click the finish buttn to move on.")
boolean = BoolSelector(false)
elements = Synthetic.UI.Pick.Elements(string, boolean)
watch = Watch(elements)
