# Dynamo graph Example Regular Expressions.dyn (Dynamo 1.3.2.2480)

# group: INPUT
string = StringInput("Testing regular expressions using this string.  Testing regular expressions using this string.  (555)724-4628.  Testing regular expressions using this string.")
string_2 = StringInput("string|regular")
string_3 = StringInput("string|regular")
string_4 = StringInput("REPLACED!")
string_5 = StringInput("\.\s*")
string_6 = StringInput("\w+")

string_7 = StringInput("Test")
string_8 = StringInput("(555)724-4628")
create = List.Create(string, string_7, string_8)

# group: OPERATIONS
isMatch = Synthetic.Core.RegEx.IsMatch(create, string_2)
match = Synthetic.Core.RegEx.Match(create, string_2)
replace = Synthetic.Core.RegEx.Replace(create, string_3, string_4)
split = Synthetic.Core.RegEx.Split(create, string_5)
matches = Synthetic.Core.RegEx.Matches(create, string_6)

# group: MONITOR
watch = Watch(isMatch)

# group: MONITOR
watch_2 = Watch(match.out0)
watch_3 = Watch(match.out1)
watch_4 = Watch(match.out2)
watch_5 = Watch(match.out3)

# group: MONITOR
watch_6 = Watch(replace)

# group: MONITOR
watch_7 = Watch(split)

# group: MONITOR
watch_8 = Watch(matches.out0)
watch_9 = Watch(matches.out1)
watch_10 = Watch(matches.out2)
watch_11 = Watch(matches.out3)
