# Dynamo graph Example RevitLinkType LoadFrom.dyn (Dynamo 2.0.2.6826)

# group: OPERATION: Get all RevitLinkType
element_types = ElementTypes(index=268)
filterElementClass = Synthetic.Revit.CollectorElementFilter.FilterElementClass(type=element_types)
byFilters = Synthetic.Revit.Collector.ByFilters(filters=filterElementClass)
toElements = Synthetic.Revit.Collector.ToElements(collector=byFilters)
name = Element.Name(element=toElements)

# group: WATCH
watch = Watch(name)

# group: INPUTS
# note: Path to Directory where links are to be repathed
directory_path = Directory("D:\Dropbox\Architecture - SMPC Architects\17026 Del Norte ES")
# note: Select which link to LoadFrom
number_slider = DoubleSlider(2, range=0..100 step 0.1)
# note: Proceed with LoadFrom
# TRUE: Proceed
# FALSE: Test script but don't LoadFrom.
boolean = BoolSelector(true)

# group: OPERATION: Select the Link to be LoadFrom
code_block = CodeBlock(dirPath=directory_path, selectLink=number_slider, proceed=boolean, l1=toElements, l2=name) { dirPath; selectLink; proceed; l1[selectLink]; l2[selectLink]; }
string = StringInput("\")
concat = String.Concat(string0=code_block.dirPath, string1=string, string2=code_block.out4)

# group: WATCH
watch_2 = Watch(concat)

code_block_2 = CodeBlock { null; }
if_ = If(test=code_block.proceed, true=code_block.out3, false=code_block_2)

# group: OPERATION: LoadFrom
loadFrom = Synthetic.Revit.RevitLinkTypes.LoadFrom(LinkType=if_, FilePath=concat)

watch_3 = Watch(loadFrom)
