# Dynamo graph Example RoundInches.dyn (Dynamo 1.2.1.3083)

# group: Input
# note: Example of replication with lists in both inputs.
number_from_feet_and_inches = LengthFromString(3.18849375)
number_from_feet_and_inches_2 = LengthFromString(0.35798125)
# note: The precision is a number (double) that represents the fraction to round in inches.
code_block = CodeBlock { 1/4; 1; }

# group: OPERATIONS
create = List.Create(number_from_feet_and_inches, number_from_feet_and_inches_2)
create_2 = List.Create(code_block.out0, code_block.out1)
# note: Custom node from Synthetic
roundInches = Custom[RoundInches](number=create, precision=create_2)  # Round a number to the nearest inch or fractional inch.
# note: Custom node from SpringNodes
feet2Fraction = Custom[Feet2Fraction](number=roundInches)  # Converts a decimal foot value to a fractional foot/inch string.

# group: MONITOR
watch = Watch(feet2Fraction)

# group: Input
# note: Example of replication with a list in the initial input.
number_from_feet_and_inches_3 = LengthFromString(3.18849375)
number_from_feet_and_inches_4 = LengthFromString(0.35798125)
# note: The precision is a number (double) that represents the fraction to round in inches.
code_block_2 = CodeBlock { 1/4; }

# group: OPERATIONS
create_3 = List.Create(number_from_feet_and_inches_3, number_from_feet_and_inches_4)
# note: Custom node from Synthetic
roundInches_2 = Custom[RoundInches](number=create_3, precision=code_block_2)
# note: Custom node from SpringNodes
feet2Fraction_2 = Custom[Feet2Fraction](number=roundInches_2)

# group: MONITOR
watch_2 = Watch(feet2Fraction_2)

# group: Input
# note: Example with single values for both inputs.
number_from_feet_and_inches_5 = LengthFromString(3.18849375)
# note: The precision is a number (double) that represents the fraction to round in inches.
code_block_3 = CodeBlock { 1/4; }

# group: Function
# note: Custom node from Synthetic Utilities
roundInches_3 = Custom[RoundInches](number=number_from_feet_and_inches_5, precision=code_block_3)
# note: Custom node from SpringNodes
feet2Fraction_3 = Custom[Feet2Fraction](number=roundInches_3)

# group: Monitor
watch_3 = Watch(feet2Fraction_3)
