# Dynamo graph Example Serialize Elements to JSON.dyn (Dynamo 2.0.3.8810)

# group: INPUT
# note: Elements to collect
element_types = ElementTypes(index=320)
# note: TRUE -> Write to File
# FALSE -> HOLD
boolean = BoolSelector(true)
# note: Path to json file.
file_path = Filename("G:\My Drive\Assets\!Revit Experiments\Serialize JSON\Serialize TextNoteTypes.json")

# group: OPERATION: Get all Elements of Class in the Document
# note: Custom Node: Synthetic
#    v. 1.3.190629
filterElementClass = Synthetic.Revit.CollectorElementFilter.FilterElementClass(type=element_types)
byFilters = Synthetic.Revit.Collector.ByFilters(filters=filterElementClass)
toElements = Synthetic.Revit.Collector.ToElements(collector=byFilters)

# group: WATCH: Collected Elements
name = Element.Name(element=toElements)
watch = Watch(name)

code_block = CodeBlock(execute=boolean, filepath=file_path) { execute; filepath; }

# group: OPERATION: Serialize Elements to JSON
# note: Custom Node: Synthetic
#    v. 1.3.190629
byDynamoElement = Synthetic.Serialize.Revit.SerializeJSON.ByDynamoElement(dynamoElement=toElements)
serializeToJson = Synthetic.Serialize.Revit.SerializeJSON.SerializeToJson(serialList=byDynamoElement)

# group: OPERATION: Write JSON to file
code_block_2 = CodeBlock { null; }
if_ = If(test=code_block.execute, true=code_block.filepath, false=code_block_2)
writeText = FileSystem.WriteText(filePath=if_, text=serializeToJson)

# group: WATCH: JSON
watch_2 = Watch(serializeToJson)
