# Dynamo graph Example Serialize View To JSON.dyn (Dynamo 2.0.2.6826)

views = Views(index=8)
byDynamoElement = Synthetic.Serialize.Revit.SerializeJSON.ByDynamoElement(dynamoElement=views)
serializeToJson = Synthetic.Serialize.Revit.SerializeJSON.SerializeToJson(serialList=byDynamoElement)
watch = Watch(serializeToJson)
string = StringInput("Architectural Plan")
getViewTemplateByName = Synthetic.Revit.ViewTemplate.GetViewTemplateByName(name=string)
unwrapViewTemplate = Synthetic.Revit.ViewTemplate.UnwrapViewTemplate(viewTemplate=getViewTemplateByName)
boolean = BoolSelector(false)
file_path = Filename("..\..\..\..\Testing\SerializeJSON\Test JSON Views.json")
code_block = CodeBlock { null; }
if_ = If(test=boolean, true=file_path, false=code_block)
writeText = FileSystem.WriteText(filePath=if_, text=serializeToJson)
boolean_2 = BoolSelector(false)
file_path_2 = Filename("..\..\..\..\Testing\SerializeJSON\Test JSON Views.json")
code_block_2 = CodeBlock { null; }
if_2 = If(test=boolean_2, true=file_path_2, false=code_block_2)
readText = FileSystem.ReadText(file=if_2)
deserializeByJson = Synthetic.Serialize.Revit.SerializeJSON.DeserializeByJson(Json=readText)
watch_2 = Watch(deserializeByJson)
modifyElement = Synthetic.Serialize.Revit.SerializeJSON.ModifyElement()  # unwired: serialElement
code_block_3 = CodeBlock { null; }
if_3 = If(test=boolean_2, true=modifyElement, false=code_block_3)
start = Revit.Transaction.Transaction.Start(input=if_3)
function_apply = ApplyFunction(func=start, arg1=deserializeByJson)
end = Revit.Transaction.Transaction.End(input=function_apply)
watch_3 = Watch(end)
