# Dynamo graph Example Sheets Create Placeholders.dyn (Dynamo 2.2.1.5175)

file_path = Filename("\\server05\BIM\MCCO\BIM\Sheet List MGE 191115.xls")
file_from_path = FileObject(path=file_path)
string = StringInput("Sheet1")
importExcel = Data.ImportExcel(file=file_from_path, sheetName=string)
transpose = List.Transpose(lists=importExcel)
watch = Watch(transpose)
code_block = CodeBlock(l=transpose) { l[0]; l[1]; l[2]; l[3]; }
createPlaceHolderSheet = Synthetic.Revit.Sheet.CreatePlaceHolderSheet(SheetNumber=code_block.out0, SheetTitle=code_block.out1)
watch_2 = Watch(createPlaceHolderSheet)
code_block_2 = CodeBlock { "Sheet Name"; "Drawing Set"; "Drawing Subset"; }
setParameterByName = Element.SetParameterByName(element=createPlaceHolderSheet, parameterName=code_block_2.out1, value=code_block.out2)
watch_3 = Watch(setParameterByName)
setParameterByName_2 = Element.SetParameterByName(element=createPlaceHolderSheet, parameterName=code_block_2.out2, value=code_block.out3)
watch_4 = Watch(setParameterByName_2)
