# Dynamo graph Example SyncWithCentral.dyn (Dynamo 1.3.2.2480)

current = Synthetic.Revit.Document.Current()
synchronizeWithCentralOptions = Synthetic.Revit.Document.SynchronizeWithCentralOptions()
string = StringInput("Test Sync")
boolean = BoolSelector(false)
synchronizeWithCentral = Synthetic.Revit.Document.SynchronizeWithCentral(current, synchronizeWithCentralOptions, string, boolean)
