# Dynamo graph Example TextNoteTypes Merge.dyn (Dynamo 2.0.3.8810)

# group: INFO: Excel Format
# note: 1ST COLUMN -> Thest TextNoteTypes will be merged into 2ND COLUMN.
# 2ND COLUMN -> TextNoteTypes to be merged into.

# group: INPUT
# note: Path to Excel file
file_path_excel_file = Filename("..\..\..\..\..\..\Documents\TextNoteType Merge List.xlsx")
# note: Name of Sheet in Excel
string_excel_sheet_name = StringInput("Sheet1")
# note: TRUE -> Show Excel
# FALSE -> Hide Excel
boolean_show_excel = BoolSelector(true)

# group: OPERATION: Import Data from Excel
file_from_path = FileObject(path=file_path_excel_file)
importExcel = Data.ImportExcel(file=file_from_path, sheetName=string_excel_sheet_name, showExcel=boolean_show_excel)
transpose = List.Transpose(lists=importExcel)
code_block = CodeBlock(l=transpose) { l[0]; l[1]; }

# group: OPERATION: Select TextNoteTypes
code_block_2 = CodeBlock(MergeFrom=code_block.out0) { MergeFrom; }
element_types = ElementTypes(index=320)
# note: TextNoteTypes to merge from
dynamoElementByNameClass = Synthetic.Revit.Select.DynamoElementByNameClass(Name=code_block_2, Class=element_types)
code_block_3 = CodeBlock(MergeInto=code_block.out1) { MergeInto; }
# note: TextNoteTypes to merge into
dynamoElementByNameClass_2 = Synthetic.Revit.Select.DynamoElementByNameClass(Name=code_block_3, Class=element_types)

boolean = BoolSelector(true)

# group: OPERATION: Select all instances of TextNoteTypes
element_types_2 = ElementTypes(index=319)
filterElementClass = Synthetic.Revit.CollectorElementFilter.FilterElementClass(type=element_types_2)
selectBuiltIn = DropDownBuiltInParameters(index=574)  # "Parameters.SelectBuiltIn"
id = Element.Id(element=dynamoElementByNameClass)
numericRules = FilterNumericRulesDropDown(index=0)  # "FilterParameter.NumericRules"
filterElementIdParameter = Synthetic.Revit.CollectorElementFilter.FilterElementIdParameter(parameterId=selectBuiltIn, value=id, filterNumberRule=numericRules)
filterLogicalOr = Synthetic.Revit.CollectorElementFilter.FilterLogicalOr(filters=filterElementIdParameter)
list_create = List.Create(item0=filterElementClass, item1=filterLogicalOr)
byFilters = Synthetic.Revit.Collector.ByFilters(filters=list_create)
toElements = Synthetic.Revit.Collector.ToElements(collector=byFilters, toggle=boolean)

# group: WATCH: TextNote Instances to Modify
name = Element.Name(element=toElements)
watch = Watch(name)

string = StringInput("Normal - 3/32\"")

# group: OPERATION: Change all instances' Type.
code_block_4 = CodeBlock(element=toElements, value=dynamoElementByNameClass_2) { element; "Type"; value; }
setParameterByName = Element.SetParameterByName(element=code_block_4.element, parameterName=code_block_4.out1, value=code_block_4.value)

code_block_5 = CodeBlock { ["Note", "Note 2", "Note 3"]; }
string_2 = StringInput("Note")
string_3 = StringInput("Note 2")
string_4 = StringInput("Note 3")
list_create_2 = List.Create(item0=string_2, item1=string_3, item2=string_4)

# group: WATCH: Merge these TextNoteTypes
name_2 = Element.Name(element=dynamoElementByNameClass)
watch_2 = Watch(name_2)

# group: WATCH: TextNoteTypes to Merge Into
name_3 = Element.Name(element=dynamoElementByNameClass_2)
watch_3 = Watch(name_3)
