# Dynamo graph Example TextNoteTypes Merge2.dyn (Dynamo 2.0.2.6826)

# group: INPUT
string = StringInput("1/4\" Arial")
string_2 = StringInput("Schedule Default")
list_create = List.Create(item0=string, item1=string_2)
element_types = ElementTypes(index=320)
string_3 = StringInput("3/32\" Arial")

# group: OPERATION: Select TextNoteTypes and Merge
dynamoElementByNameClass = Synthetic.Revit.Select.DynamoElementByNameClass(Name=list_create, Class=element_types)
dynamoElementByNameClass_2 = Synthetic.Revit.Select.DynamoElementByNameClass(Name=string_3, Class=element_types)
mergeTextNoteTypes = Synthetic.Revit.Tools.MergeTextNoteTypes(FromType=dynamoElementByNameClass, ToType=dynamoElementByNameClass_2)

# group: WATCH: Merged TextNote Instances
name = Element.Name(element=mergeTextNoteTypes.Elements_Merged)
watch = Watch(name)

# group: WATCH: TextNote Instances that failed to merge
name_2 = Element.Name(element=mergeTextNoteTypes.Failed)
watch_2 = Watch(name_2)
