# Dynamo graph Example View ApplyParameters.dyn (Dynamo 1.3.2.2480)

element_types = ElementTypes("ViewPlan")
filterElementClass = Synthetic.Revit.CollectorElementFilter.FilterElementClass(element_types)
byFilters = Synthetic.Revit.Collector.ByFilters(filterElementClass)
string = StringInput("Level 1")
queryNameContains = Synthetic.Revit.Collector.QueryNameContains(byFilters, string)
code_block = CodeBlock(l=queryNameContains) { l[0]; l[1]; }
applyViewParameters = Synthetic.Revit.View.ApplyViewParameters(code_block.out0, code_block.out1)
transferParameters = Synthetic.Revit.Elements.TransferParameters(code_block.out0, code_block.out1)
parameters = Element.Parameters(transferParameters)
watch = Watch(parameters)
getTemplateParameterIds = Synthetic.Revit.View.GetTemplateParameterIds(code_block.out1)
watch_2 = Watch(getTemplateParameterIds)
getNonControlledTemplateParameterIds = Synthetic.Revit.View.GetNonControlledTemplateParameterIds(code_block.out1)
watch_3 = Watch(getNonControlledTemplateParameterIds)
