# Dynamo graph Example Views Renumber on Active Sheet.dyn (Dynamo 1.3.4.6666)

# note: Change boolean to re-run script
boolean_reset_script = BoolSelector(false)

# group: INPUTS
# note: Select -> Titleblock Location Marker family.
family_types_origin_marker = FamilyTypes("Titleblock Grid Location Marker:Location Marker INC Titleblock - CD")
# note: Name of Grid Size Parameters
string_grid_spacing_x_direction = StringInput("Grid Size X Direction")
string_grid_spacing_y_direction = StringInput("Grid Size Y Direction")

if_ = If(test=boolean_reset_script, true=family_types_origin_marker, false=family_types_origin_marker)

# group: OPERATIONS
# note: PACKAGE: Synthetic
renumberOnActiveSheet = Synthetic.Revit.View.RenumberOnActiveSheet(if_, string_grid_spacing_x_direction, string_grid_spacing_y_direction)

# group: WATCH: Renumbered Viewports
watch = Watch(renumberOnActiveSheet)
