# Dynamo graph Example Views Renumber on Sheet.dyn (Dynamo 1.3.4.6666)

# group: OPERATION: Get Active Sheet
element_types = ElementTypes("ViewSheet")
# note: PACKAGE: Synthetic
filterElementClass = Synthetic.Revit.CollectorElementFilter.FilterElementClass(element_types)
activeView = Synthetic.Revit.View.ActiveView()
id = Synthetic.Revit.Elements.Id(activeView)
byFiltersElemIds = Synthetic.Revit.Collector.ByFiltersElemIds(filterElementClass, id)
toElements = Synthetic.Revit.Collector.ToElements(byFiltersElemIds)
toInt = Synthetic.Revit.ElementId.ToInt(id)

# group: WATCH: List of sheets
name = Element.Name(toElements)
watch = Watch(name)

# group: INPUTS
# note: TRUE: Execute Renumbering
# FALSE: Test graph, but do not renumber.
boolean_test_graph = BoolSelector(true)
# note: Select -> Titleblock Location Marker family.
family_types_origin_marker = FamilyTypes("Titleblock Grid Location Marker:Locatin Marker INC Titleblock - CD")
# note: TRUE: Project Units = feet
# FALSE: Project Units = inches
boolean_feet_or_inches = BoolSelector(true)
# note: Name of Grid Size Parameters
string = StringInput("Grid Size X Direction")
string_2 = StringInput("Grid Size Y Direction")

# group: CONTROL
code_block = CodeBlock { null; }
if_ = If(test=boolean_test_graph, true=toElements, false=code_block)

# group: OPERATION: Get Origin Marker
# note: PACKAGE: Synthetic
filterFamilyInstance = Synthetic.Revit.CollectorElementFilter.FilterFamilyInstance(family_types_origin_marker)
filterElementOwnerViewById = Synthetic.Revit.CollectorElementFilter.FilterElementOwnerViewById(toInt)
create = List.Create(filterFamilyInstance, filterElementOwnerViewById)
filterLogicalAnd = Synthetic.Revit.CollectorElementFilter.FilterLogicalAnd(create)
byFilters = Synthetic.Revit.Collector.ByFilters(filterLogicalAnd)
toElements_2 = Synthetic.Revit.Collector.ToElements(byFilters)

# group: OPERATION: Get Grid Spacing
code_block_2 = CodeBlock(instancces=toElements_2, units=boolean_feet_or_inches, xGridName=string, yGridName=string_2) { instancces; units; xGridName; yGridName; }
type = FamilyInstance.Type(code_block_2.instancces)
create_2 = List.Create(code_block_2.xGridName, code_block_2.yGridName)
parameterByName = Parameter.ParameterByName(element=type, name=create_2, lacing=CrossProduct)
value = Parameter.Value(parameterByName)
code_block_3 = CodeBlock { 1.0; 12.0; }
if_2 = If(test=code_block_2.units, true=code_block_3.out0, false=code_block_3.out1)
div = value / if_2
flatten = Flatten(div)

# group: OPERATION: Locate Origin
location = FamilyInstance.Location(toElements_2)
X = Point.X(location)
Y = Point.Y(location)

# group: OPERATION: Renumber Sheets
code_block_4 = CodeBlock(sheet=if_, gridSize=flatten, ptX=X, ptY=Y) { sheet; gridSize[0]; gridSize[1]; ptX; ptY; }
# note: PACKAGE: Synthetic
renumberOnSheetByCoordinates = Synthetic.Revit.View.RenumberOnSheetByCoordinates(code_block_4.sheet, code_block_4.out1, code_block_4.out2, code_block_4.ptX, code_block_4.ptY)

# group: WATCH: Renumbered Viewports
watch_2 = Watch(renumberOnSheetByCoordinates)

# group: WATCH: Origin Marker
watch_3 = Watch(toElements_2)

# group: WATCH: Grid Spacing
watch_4 = Watch(flatten)

# group: WATCH: Origin Marker Family Type
watch_5 = Watch(type)

# group: WATCH: Origin Location
watch_6 = Watch(location)

typeOf = Synthetic.Core.Object.TypeOf(family_types_origin_marker)
watch_7 = Watch(typeOf)
unwrapDynamoElement = Synthetic.Revit.Elements.UnwrapDynamoElement(family_types_origin_marker)
watch_8 = Watch(unwrapDynamoElement)
